% Simulink data dictionary FailureModesGen.sldd
% references simulation_modelconfig.sldd
% references simulation_interfaces.sldd

P_SimFailureModeDetectionDelay = 6
P_SimFailureRearAxleGripMode = 0
P_SimFailureRearAxleGripStepEndTime_s = 0
P_SimFailureRearAxleGripStepTime_s = 0
P_SimFailureBrakeStepTime_s = -1
P_SimFailureTorqueStepTime_s = -1
P_SimFailureSteeringStepTime_s = -1
P_SimFailureIMU1StepTime_s = -1
P_SimFailureIMU2StepTime_s = -1
P_SimFailureWheelspeedsStepTime_s = -1
P_SimFailureVel1StepTime_s = -1
P_SimFailureVel2StepTime_s = -1
P_SimFailureLoc1StepTime_s = -1
P_SimFailureLoc2StepTime_s = -1
P_SimFailureLoc3StepTime_s = -1
P_SimFailureVehicleStepTime_s = -1
P_SimFailureSteeringActuatorStepTime_s = -1
P_SimFailureBrakeStepEndTime_s = 200
P_SimFailureTorqueStepEndTime_s = 200
P_SimFailureSteeringStepEndTime_s = 200
P_SimFailureIMU1StepEndTime_s = 200
P_SimFailureIMU2StepEndTime_s = 200
P_SimFailureWheelspeedsStepEndTime_s = 200
P_SimFailureVel1StepEndTime_s = 200
P_SimFailureVel2StepEndTime_s = 200
P_SimFailureLoc1StepEndTime_s = 200
P_SimFailureLoc2StepEndTime_s = 200
P_SimFailureLoc3StepEndTime_s = 200
P_SimFailureVehicleStepEndTime_s = 200
P_SimFailureSteeringActuatorStepEndTime_s = 200
P_SimFailureBrakeMode = 0
P_SimFailureTorqueMode = 0
P_SimFailureSteeringMode = 0
P_SimFailureIMU1Mode = 0
P_SimFailureIMU2Mode = 0
P_SimFailureWheelspeedsMode = 0
P_SimFailureVel1Mode = 0
P_SimFailureVel2Mode = 0
P_SimFailureLoc1Mode = 0
P_SimFailureLoc2Mode = 0
P_SimFailureLoc3Mode = 0
P_SimFailureVehicleMode = 0
P_SimFailureSteeringActuatorMode = 0
P_SimDetectFailures = true