% Simulink data dictionary UDPPortConfigSim.sldd

VehicleControl_Port = Simulink.Parameter(50002)
VehicleData_Port = Simulink.Parameter(50001)
OXTS_Port = Simulink.Parameter(50000)
VehicleControlManual_Port = Simulink.Parameter(50004)
VehiclePose2Env_Port_op1 = Simulink.Parameter(50006)
VehicleObj2Det_Port_op1 = Simulink.Parameter(50007)
VehicleTrj2Det_Port_op1 = Simulink.Parameter(50008)
VehiclePose2Env_Port_db = Simulink.Parameter(50003)