% Simulink data dictionary simulation_interfaces.sldd

V2X_Vehicle_Sim = Simulink.Bus()
  x_m: double
  y_m: double
  psi_rad: double
  vx_mps: double
  vy_mps: double
  dPsi_radps: double

Chassis = Simulink.Bus()
  r_I_Chassis_m: double[3 1]
  v_I_Chassis_mps: double[3 1]
  a_I_Chassis_mps2: double[3 1]
  phi_I_Chassis_rad: double[3 1]
  omega_I_Chassis_radps: double[3 1]
  alpha_I_Chassis_radps2: double[3 1]
  v_C_Chassis_mps: double[3 1]
  a_C_Chassis_mps2: double[3 1]
  omega_C_Chassis_radps: double[3 1]
  alpha_C_Chassis_radps2: double[3 1]

Transformation = Simulink.Bus()
  rotmatrix_I2V: double[3 3]
  rotmatrix_C2V: double[3 3]
  rotmatrix_I2C: double[3 3]
  rotmatrix_C2WFL: double[3 3]
  rotmatrix_C2WFR: double[3 3]
  rotmatrix_OrientationChange: double[3 3]

Force = Simulink.Bus()
  F_V_Vehicle_N: double[3 1]
  T_V_Vehicle_Nm: double[3 1]
  F_V_Drag_N: double[3 1]
  T_V_Drag_Nm: double[3 1]
  F_V_Gravity_N: double[3 1]
  F_V_Hardpoints_N: double[3 4]
  T_V_Hardpoints_Nm: double[3 4]
  F_C_Hardpoints_N: double[3 4]
  T_C_Hardpoints_Nm: double[3 4]
  F_C_Tires_N: double[3 4]
  T_C_Tires_Nm: double[3 4]
  F_T_Tires_N: double[3 4]
  T_T_Tires_Nm: double[3 4]

Vehicle = Simulink.Bus()
  r_I_Vehicle_m: double[3 1]
  v_I_Vehicle_mps: double[3 1]
  a_I_Vehicle_mps2: double[3 1]
  phi_I_Vehicle_rad: double[3 1]
  omega_I_Vehicle_radps: double[3 1]
  alpha_I_Vehicle_radps2: double[3 1]
  v_V_Vehicle_mps: double[3 1]
  a_V_Vehicle_mps2: double[3 1]
  omega_V_Vehicle_radps: double[3 1]
  alpha_V_Vehicle_radps2: double[3 1]
  r_I_Hardpoints_m: double[3 4]
  v_I_Hardpoints_mps: double[3 4]
  r_V_Cog2Hardpoints_m: double[3 4]
  v_V_Hardpoints_mps: double[3 4]

Wheel = Simulink.Bus()
  r_I_Wheels_m: double[3 4]
  v_C_Wheels_mps: double[3 4]
  re_WheelsEffective_m: double[1 4]
  omegay_W_Wheels_rad: double[1 4]
  r_I_Tires_m: double[3 4]
  kappa_Tires: double[1 4]
  alpha_Tires_rad: double[1 4]

Suspension = Simulink.Bus()
  h_Suspensions_m: double[1 4]
  wheelangles_rad: double[3 4]

VehicleParameterSet = Simulink.Bus()
  cLiftF: double
  cLiftR: double
  CoGx_m: double
  CoGy_m: double
  CoGz_m: double
  cDrag: double
  Aref_m2: double
  Gearratio: double
  Wheelbase_m: double
  PacLatF: double[5]
  PacLongF: double[5]
  PacLatR: double[5]
  PacLongR: double[5]
  cRollFriction_Npmps: double
  MaxRollFriction_N: double
  T_YawRate_s: double
  T_LatVel_s: double
  TrackWidthF_m: double
  TrackWidthR_m: double
  TireRadiusF_m: double
  TireRadiusR_m: double
  VehicleInertia_kgm2: double
  WheelInertiaF_kgm2: double
  WheelInertiaR_kgm2: double
  VehicleMass_kg: double
  switchModelBlend_mps: double
  PTLimitLowVel_N: double
  switchModelVel_mps: double
  T_Tire_s: double

SimRealState = Simulink.Bus()
  x_m: double
  y_m: double
  z_m: double
  phi_rad: double
  theta_rad: double
  psi_rad: double
  vx_mps: double
  vy_mps: double
  vz_mps: double
  dPhi_radps: double
  dTheta_radps: double
  dPsi_radps: double
  ax_mps2: double
  ay_mps2: double
  az_mps2: double
  nWheelFL_radps: double
  nWheelFR_radps: double
  nWheelRL_radps: double
  nWheelRR_radps: double
  dnWheelFL_radps2: double
  dnWheelFR_radps2: double
  dnWheelRL_radps2: double
  dnWheelRR_radps2: double
  DeltaWheel_rad: double
  T_DriveTorqueFL_Nm: double
  T_DriveTorqueFR_Nm: double
  T_DriveTorqueRL_Nm: double
  T_DriveTorqueRR_Nm: double
  p_BrakeFL_pa: double
  p_BrakeFR_pa: double
  p_BrakeRL_pa: double
  p_BrakeRR_pa: double

ActuatorLimitations_Sim = Simulink.Bus()
  SteeringAngleMax_rad: double
  SteeringAngleMin_rad: double
  DriveForceMax_N: double
  DriveForceMin_N: double

VehicleSystemStatus_Sim = Simulink.Bus()
  Hardware: double
  AIDriver: double
  ParkBrakeApplied_b: boolean
  VehicleReady2Drive: boolean

tpamapReference = Simulink.Bus()
  tpa_map: double[1 57500]
  interpTime: double[1 10]
  tpa_map_mode: double

SimInformation = Simulink.Bus()
  Vehicle: Bus: Vehicle
  Chassis: Bus: Chassis
  Suspension: Bus: Suspension
  Wheel: Bus: Wheel
  Transformation: Bus: Transformation
  Force: Bus: Force

FailureModes = Simulink.Bus()
  BrakeSensorFMDetected_b: boolean
  BrakeSensorFM: double
  TorqueSensorFMDetected_b: boolean
  TorqueSensorFM: double
  SteeringSensorFMDetected_b: boolean
  SteeringSensorFM: double
  IMU1FMDetected_b: boolean
  IMU1FM: double
  IMU2FMDetected_b: boolean
  IMU2FM: double
  WheelspeedSensorsFMDetected_b: boolean
  WheelspeedSensorsFM: double
  Vel1FMDetected_b: boolean
  Vel1FM: double
  Vel2FMDetected_b: boolean
  Vel2FM: double
  Loc1FMDetected_b: boolean
  Loc1FM: double
  Loc2FMDetected_b: boolean
  Loc2FM: double
  Loc3FMDetected_b: boolean
  Loc3FM: double
  VehicleFMDetected_b: boolean
  VehicleFM: double
  SteeringActuatorFMDetected_b: boolean
  SteeringActuatorFM: double

VehicleSensorData_Sim = Simulink.Bus()
  Tz_Powertrain_Nm: double
  Fx_Powertrain_N: double
  T_Engine_Nm: double
  GearEngaged: int16
  omega_Engine_radps: double
  ThrottlePos_perc: double
  T_WheelFL_Nm: double
  T_WheelFR_Nm: double
  T_WheelRL_Nm: double
  T_WheelRR_Nm: double
  Delta_Wheel_rad: double
  p_BrakeF_bar: double
  p_BrakeR_bar: double
  omega_WheelFL_radps: double
  omega_WheelFR_radps: double
  omega_WheelRL_radps: double
  omega_WheelRR_radps: double
  valid_Wheelspeeds_b: boolean
  x_Loc1_m: double
  y_Loc1_m: double
  z_Loc1_m: double
  phi_RollAngleLoc1_rad: double
  theta_PitchAngleLoc1_rad: double
  psi_YawAngleLoc1_rad: double
  t_EstimateLoc1_s: double
  valid_Loc1_b: boolean
  accuracy_Loc1: double[3]
  x_Loc2_m: double
  y_Loc2_m: double
  z_Loc2_m: double
  phi_RollAngleLoc2_rad: double
  theta_PitchAngleLoc2_rad: double
  psi_YawAngleLoc2_rad: double
  t_EstimateLoc2_s: double
  valid_Loc2_b: boolean
  accuracy_Loc2: double[3]
  x_Loc3_m: double
  y_Loc3_m: double
  z_Loc3_m: double
  phi_RollAngleLoc3_rad: double
  theta_PitchAngleLoc3_rad: double
  psi_YawAngleLoc3_rad: double
  t_EstimateLoc3_s: double
  valid_Loc3_b: boolean
  accuracy_Loc3: double[3]
  vx_CoGVel1_mps: double
  vy_CoGVel1_mps: double
  valid_Vel1_b: boolean
  vx_CoGVel2_mps: double
  vy_CoGVel2_mps: double
  valid_Vel2_b: boolean
  ax_CoGIMU1_mps2: double
  ay_CoGIMU1_mps2: double
  az_CoGIMU1_mps2: double
  dPhi_RollRateIMU1_radps: double
  dTheta_PitchRateIMU1_radps: double
  dPsi_YawRateIMU1_radps: double
  valid_IMU1_b: boolean
  ax_CoGIMU2_mps2: double
  ay_CoGIMU2_mps2: double
  az_CoGIMU2_mps2: double
  dPhi_RollRateIMU2_radps: double
  dTheta_PitchRateIMU2_radps: double
  dPsi_YawRateIMU2_radps: double
  valid_IMU2_b: boolean

PowertrainInformation = Simulink.Bus()
  p_throttle_pos: double
  T_engine_Nm: double
  w_engine_radps: double
  T_loss_Nm: double
  T_clutch_Nm: double
  T_cap_Nm: double
  wdot_engine_radps2: double
  clutch_engagement: double
  gear: double
  w_transmission_radps: double
  T_transmission_Nm: double
  w_differential_radps: double