% Simulink data dictionary pa_sim_nonlineardtm_initialvalues.sldd

omega0_Wheels_radps = Simulink.Parameter([0 0 0 0])  % Initial Rotational Velocities of Wheels along Wheel Fixed y-Axes [FL FR RL RR]
v0z_Wheels_mps = Simulink.Parameter([0 0 0 0])  % Initial Wheel velocity
z0_TireDeflection_m = Simulink.Parameter([0.01434 0.01434 0.01325 0.01325])
omega0_K_Vehicle_radps = Simulink.Parameter([0; 0; 0])  % Initial angular vehicle body velocity in vehicle body fixed frame K
v0_K_Vehicle_mps = Simulink.Parameter([0; 0; 0])  % Initial vehicle body translational velocity in vehicle body fixed coordinate system K

x0_verticaldynamics = Simulink.Parameter([0 0 0])  % This variable substitutes the former variables
  % - r0_I_Vehicle_m [3x1]
  % - phi0_I_Vehicle_rad [3x1]
  % to specify the initial position and orientation of the vehicle according to
  % - x0_vehiclepose (ISO8855-coordinate convention) coming from the scenario definition
  % [x0 y0 psi0]
  % - x0_verticaldynamics (SAE J670 coordinate convention) for the remaining initial states
  % [z0 phi0 theta0]