% Simulink data dictionary pa_sim_nonlineardtm_suspensionparameters.sldd

Kinematics = Simulink.Parameter(struct(
  nu0_SuspensionToeFB_rad=[0 0],
  tau0_SuspensionCasterFB_rad=[0 0],
  gamma0_SuspensionCamberFB_rad=[0 0],
  k_SuspensionRollSteerOverHeightFB_radpm=[0 0],
  k_SuspensionToeOverSteeringF=0,
  k_SuspensionCasterOverHeightFB=[0 0],
  k_SuspensionCasterOverSteeringF=0,
  k_SuspensionCamberOverHeightFB=[0 0],
  k_SuspensionCamberOverSteeringF=0,
  k_SuspensionHeightOverSteeringF_mprad=0))

Antisway = Simulink.Parameter(struct(
  r_AntiSwayArmRadiusFB_m=[0.4 0.3],
  phi_AntiSwayNeutralArmFB_rad=[0 0],
  c_SpringAntiSwayFB_Nmprad=[5000 2500]))

Compliance = Simulink.Parameter(struct(
  c_SpringSuspensionFB_Npm=[12000 80000],
  F0z_SpringSuspensionFB_N=[2000 3000],
  d_DamperSuspensionFB_Nspm=[2000 1000],
  hmax_SuspensionFB_m=[0.5 0.5]))