% Simulink data dictionary pa_sim_nonlineardtm_vehicleparameters.sldd

Environment = Simulink.Parameter(struct(p_Air_Pa=101325, t_Air_K=293.15, a_Gravity_mps2=9.81))

SensorData = Simulink.Parameter(struct(
  r_K_KS1_m=[0; 0; 0],
  r_K_KS2_m=[0; 0; 0],
  r_K_KS3_m=[0; 0; 0],
  phi0_K_KS1_rad=[0; 0; 0],
  phi0_K_KS2_rad=[0; 0; 0],
  phi0_K_KS3_rad=[0; 0; 0]))

VehicleSimulation = Simulink.Parameter(struct(Sim_LongVelTol_mps=0.01, Sim_LatOff_m=0, Sim_LongOff_m=0, Sim_VertOff_m=0))

VehicleData = Simulink.Parameter(struct(
  m_Vehicle_kg=1300,
  l_WheelbaseF_m=1.4,
  l_WheelbaseR_m=2,
  w_TrackF_m=1.7,
  w_TrackR_m=1.7,
  w_SymmetryLineCog_m=0,
  h_AxlePlaneCog_m=0.02,
  I_K_Vehicle_kgm2=[300 0 0; 0 1000 0; 0 0 1500]))

Aerodynamics = Simulink.Parameter(struct(
  A_LongitudinalDrag_m2=1,
  cw_LongitudinalDrag=2.3,
  cl_LongitudinalLift=3,
  cp_LongitudinalDragPitchMoment=0,
  beta_Wind_rad=[0 0.01 0.02 0.03 0.04 0.05 0.06 0.07 0.08 0.09 0.1],
  cs_LateralDragCoefficients=repmat(0, 1, 11),
  cy_DragYawMomentCoefficients=repmat(0, 1, 11)))