% Simulink data dictionary pa_sim_nonlineardtm_wheelparameters.sldd

Turnslip = Simulink.Parameter(struct(
  PDXP1=[0.4 0.4 0.4 0.4],
  PDXP2=[0 0 0 0],
  PDXP3=[0 0 0 0],
  PKYP1=[1 1 1 1],
  PDYP1=[0.4 0.4 0.4 0.4],
  PDYP2=[0 0 0 0],
  PDYP3=[0 0 0 0],
  PDYP4=[0 0 0 0],
  PHYP1=[1 1 1 1],
  PHYP2=[0.15 0.15 0.15 0.15],
  PHYP3=[0 0 0 0],
  PHYP4=[-4 -4 -4 -4],
  PECP1=[0.5 0.5 0.5 0.5],
  PECP2=[0 0 0 0],
  QDTP1=[10 10 10 10],
  QCRP1=[0.2 0.2 0.2 0.2],
  QCRP2=[0.1 0.1 0.1 0.1],
  QBRP1=[0.1 0.1 0.1 0.1],
  QDRP1=[1 1 1 1],
  QDRP2=[0 0 0 0]))

Rolling = Simulink.Parameter(struct(
  QSY1=[0.01 0.01 0.01 0.01],
  QSY2=[0 0 0 0],
  QSY3=[0 0 0 0],
  QSY4=[0 0 0 0],
  QSY5=[0 0 0 0],
  QSY6=[0 0 0 0],
  QSY7=[1 1 1 1],
  QSY8=[1 1 1 1]))

ContactPatch = Simulink.Parameter(struct(Q_RA1=[0 0 0 0], Q_RA2=[0 0 0 0], Q_RB1=[0 0 0 0], Q_RB2=[0 0 0 0]))

p_Tires_Pa = Simulink.Parameter([220000 220000 220000 220000])  % Tire Pressure in Pa for each tire. Currently there is no effect of tire pressure
  % on the resulting tire forces since all coefficients on the influence of changes
  % of tire pressure are set to zero in the tire model.
  % The block to compute the tire forces however requires the tire pressure as input.

k2_TireFB_PT1 = Simulink.Parameter([0.002 0.002])
k1_WheelsFB_PT1 = Simulink.Parameter([0.002 0.002])
k1_TireFB_PT1 = Simulink.Parameter([0.002 0.002])

Scaling = Simulink.Parameter(struct(
  lambda_Fz0=[1 1 1 1],
  lambda_muV=[0 0 0 0],
  lambda_Kxkappa=[1 1 1 1],
  lambda_Kyalpha=[1 1 1 1],
  lambda_Cx=[1 1 1 1],
  lambda_Cy=[1 1 1 1],
  lambda_Ex=[1 1 1 1],
  lambda_Ey=[1 1 1 1],
  lambda_Hx=[1 1 1 1],
  lambda_Hy=[1 1 1 1],
  lambda_Vx=[1 1 1 1],
  lambda_Vy=[1 1 1 1],
  lambda_Kygamma=[1 1 1 1],
  lambda_Kzgamma=[1 1 1 1],
  lambda_t=[1 1 1 1],
  lambda_Mr=[1 1 1 1],
  lambda_xalpha=[1 1 1 1],
  lambda_ykappa=[1 1 1 1],
  lambda_Vykappa=[1 1 1 1],
  lambda_s=[1 1 1 1],
  lambda_Cz=[1 1 1 1],
  lambda_Mx=[1 1 1 1],
  lambda_VMx=[1 1 1 1],
  lambda_My=[1 1 1 1],
  lambda_Mphi=[1 1 1 1]))

Vertical = Simulink.Parameter(struct(
  BREFF=[3.0e-8 3.0e-8 3.0e-8 3.0e-8],
  DREFF=[0 0 0 0],
  FREFF=[0 0 0 0],
  Q_RE0=[1 1 1 1],
  Q_V1=[0 0 0 0],
  Q_V2=[0 0 0 0],
  Q_FZ1=[20 20 20 20],
  Q_FZ2=[0 0 0 0],
  Q_FZ3=[0 0 0 0],
  Q_FCX=[0 0 0 0],
  Q_FCY=[0 0 0 0],
  Q_FCY2=[0 0 0 0],
  PFZ1=[0 0 0 0],
  VERTICAL_STIFFNESS=[200000 200000 200000 200000],
  VERTICAL_DAMPING=[100 100 100 100]))

TireSimulation = Simulink.Parameter(struct(
  PRESMAX=[1000000 1000000 1000000 1000000],
  PRESMIN=[10000 10000 10000 10000],
  FZMAX=[20000 20000 20000 20000],
  FZMIN=[1 1 1 1],
  VXLOW=[1 1 1 1],
  KPUMAX=[1.5 1.5 1.5 1.5],
  KPUMIN=[-1.5 -1.5 -1.5 -1.5],
  ALPMAX=[1.6 1.6 1.6 1.6],
  ALPMIN=[-1.6 -1.6 -1.6 -1.6],
  CAMMAX=[0.32 0.32 0.32 0.32],
  CAMMIN=[-0.32 -0.32 -0.32 -0.32],
  LONGVL=[9 9 9 9]))

Structural = Simulink.Parameter(struct(
  LONGITUDINAL_STIFFNESS=[380000 380000 380000 380000],
  LATERAL_STIFFNESS=[100000 100000 100000 100000],
  PCFX1=[0 0 0 0],
  PCFX2=[0 0 0 0],
  PCFX3=[0 0 0 0],
  PCFY1=[0 0 0 0],
  PCFY2=[0 0 0 0],
  PCFY3=[0 0 0 0]))

Longitudinal = Simulink.Parameter(struct(
  PCX1=[1.5 1.5 1.5 1.5],
  PDX1=[1.4 1.4 1.4 1.4],
  PDX2=[-0.05 -0.05 -0.05 -0.05],
  PDX3=[0.1 0.1 0.1 0.1],
  PEX1=[0.7 0.7 0.7 0.7],
  PEX2=[-0.16 -0.16 -0.16 -0.16],
  PEX3=[0.018 0.018 0.018 0.018],
  PEX4=[-0.11 -0.11 -0.11 -0.11],
  PKX1=[28 28 28 28],
  PKX2=[0.25 0.25 0.25 0.25],
  PKX3=[0.1 0.1 0.1 0.1],
  PHX1=[0 0 0 0],
  PHX2=[0 0 0 0],
  PVX1=[0 0 0 0],
  PVX2=[0 0 0 0],
  PPX1=[0 0 0 0],
  PPX2=[0 0 0 0],
  PPX3=[0 0 0 0],
  PPX4=[0 0 0 0],
  RBX1=[15 15 15 15],
  RBX2=[10 10 10 10],
  RBX3=[0 0 0 0],
  RCX1=[1 1 1 1],
  REX1=[0 0 0 0],
  REX2=[0 0 0 0],
  RHX1=[0.001 0.001 0.001 0.001]))

Overturning = Simulink.Parameter(struct(
  QSX1=[-0.001 -0.001 0.001 0.001],
  QSX2=[2.25 2.25 2.25 2.25],
  QSX3=[-0.04 -0.04 -0.04 -0.04],
  QSX4=[0 0 0 0],
  QSX5=[0 0 0 0],
  QSX6=[0 0 0 0],
  QSX7=[0 0 0 0],
  QSX8=[0 0 0 0],
  QSX9=[0 0 0 0],
  QSX10=[0 0 0 0],
  QSX11=[0 0 0 0],
  QSX12=[0 0 0 0],
  QSX13=[0 0 0 0],
  QSX14=[0 0 0 0],
  PPMX1=[0 0 0 0]))

Lateral = Simulink.Parameter(struct(
  PCY1=[1.75 1.75 1.75 1.75],
  PDY1=[1.45 1.45 1.45 1.45],
  PDY2=[-0.1 -0.1 -0.1 -0.1],
  PDY3=[0.1 0.1 0.1 0.1],
  PEY1=[0.1 0.1 0.1 0.1],
  PEY2=[-1 -1 -1 -1],
  PEY3=[0 0 0 0],
  PEY4=[-8 -8 -8 -8],
  PEY5=[0 0 0 0],
  PKY1=[-80 -80 -80 -80],
  PKY2=[5 5 5 5],
  PKY3=[-0.6 -0.6 -0.6 -0.6],
  PKY4=[2.5 2.5 2.5 2.5],
  PKY5=[0 0 0 0],
  PKY6=[0 0 0 0],
  PKY7=[0 0 0 0],
  PHY1=[0 0 0 0],
  PHY2=[0 0 0 0],
  PVY1=[0.05 0.05 0.05 0.05],
  PVY2=[-0.05 -0.05 -0.05 -0.05],
  PVY3=[-1 -1 -1 -1],
  PVY4=[-0.3 -0.3 -0.3 -0.3],
  PPY1=[0 0 0 0],
  PPY2=[0 0 0 0],
  PPY3=[0 0 0 0],
  PPY4=[0 0 0 0],
  PPY5=[0 0 0 0],
  RBY1=[15 15 15 15],
  RBY2=[-15 -15 -15 -15],
  RBY3=[0.001 0.001 0.001 0.001],
  RBY4=[0 0 0 0],
  RCY1=[1 1 1 1],
  REY1=[0 0 0 0],
  REY2=[0 0 0 0],
  RHY1=[-0.01 -0.01 -0.01 -0.01],
  RHY2=[0 0 0 0],
  RVY1=[0.1 0.1 0.1 0.1],
  RVY2=[0.035 0.035 0.035 0.035],
  RVY3=[32 32 32 32],
  RVY4=[-32 -32 -32 -32],
  RVY5=[0.02 0.02 0.02 0.02],
  RVY6=[0 0 0 0]))

Aligning = Simulink.Parameter(struct(
  QBZ1=[8 8 8 8],
  QBZ2=[6 6 6 6],
  QBZ3=[-1 -1 -1 -1],
  QBZ4=[-3 -3 -3 -3],
  QBZ5=[3 3 3 3],
  QBZ6=[0 0 0 0],
  QBZ9=[-10 -10 -10 -10],
  QBZ10=[0 0 0 0],
  QCZ1=[1 1 1 1],
  QDZ1=[0.2 0.2 0.2 0.2],
  QDZ2=[0.002 0.002 0.002 0.002],
  QDZ3=[-1.5 -1.5 -1.5 -1.5],
  QDZ4=[0 0 0 0],
  QDZ6=[0 0 0 0],
  QDZ7=[0 0 0 0],
  QDZ8=[0 0 0 0],
  QDZ9=[0 0 0 0],
  QDZ10=[0 0 0 0],
  QDZ11=[0 0 0 0],
  QEZ1=[-11 -11 -11 -11],
  QEZ2=[12 12 12 12],
  QEZ3=[-5 -5 -5 -5],
  QEZ4=[0 0 0 0],
  QEZ5=[-20 -20 -20 -20],
  QHZ1=[0.01 0.01 0.01 0.01],
  QHZ2=[0.01 0.01 0.01 0.01],
  QHZ3=[-0.25 -0.25 -0.25 -0.25],
  QHZ4=[0.25 0.25 0.25 0.25],
  PPZ1=[0 0 0 0],
  PPZ2=[0 0 0 0],
  SSZ1=[-0.01 -0.01 -0.01 -0.01],
  SSZ2=[0.25 0.25 0.25 0.25],
  SSZ3=[2 2 2 2],
  SSZ4=[-1 -1 -1 -1]))

Brakes = Simulink.Parameter(struct(
  mue_BrakePadsStaticFB=[0.6 0.6],
  mue_BrakePadsKineticFB=[0.6 0.6],
  d_BrakeBoreDiameterFB_m=[0.075 0.075],
  r_BrakePadsMeanLeverRadiusFB_m=[0.357 0.357],
  n_BrakePadsNumberFB=[1 1]))

Wheels = Simulink.Parameter(struct(
  mue_Wheels=[0.001 0.001 0.001 0.001],
  UNLOADED_RADIUS=[0.42 0.42 0.42 0.42],
  NOMPRES=[210000 210000 210000 210000],
  FNOMIN=[2500 2500 2500 2500],
  WIDTH=[0.22 0.22 0.22 0.22],
  m_WheelsFB_kg=[80 95],
  Iyy_WheelsFB_kgm2=[2 2],
  a_Gravity_mps2=9.81))