% Simulink data dictionary racetrack.sldd

Racetrack = struct(
  ValidPointCnt=1637,
  x_ref_m=[296.8706345; 295.7202452; 294.5729588; 293.4287848; 292.2877329; 291.1498126; 290.0150333; 288.8834046; 287.754936; 286.6296368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 0],
  y_ref_m=[690.6423386; 689.6808817; 688.7157243; 687.7468792; 686.774359; 685.7981765; 684.8183444; 683.8348753; 682.8477818; 681.8570767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 0],
  width_right_m=[11.5758896; 11.5912445; 11.6021197; 11.6084549; 11.6110751; 11.6102437; 11.6067203; 11.6010598; 11.5939189; 11.5867401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 0],
  width_left_m=[3.7176993; 3.7446779; 3.7675791; 3.7868633; 3.8027425; 3.8156582; 3.8256871; 3.8331894; 3.8383433; 3.8425904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 0],
  x_normvec_m=[-0.6400484; -0.6425208; -0.6449848; -0.6474402; -0.6498872; -0.6523257; -0.6547558; -0.6571774; -0.6595906; -0.6619954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 0],
  y_normvec_m=[0.7683346; 0.7662682; 0.7641954; 0.7621162; 0.7600307; 0.7579388; 0.7558405; 0.7537359; 0.7516251; 0.7495079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 0],
  psi_racetraj_rad=[2.2656578; 2.2699891; 2.2699891; 2.2743094; 2.2786188; 2.2829173; 2.2829173; 2.287205; 2.291482; 2.2957483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 0],
  bankingangle_rad=[-0.1571; -0.1571; -0.1571; -0.1571; -0.1571; -0.1571; -0.1571; -0.1571; -0.1571; -0.1571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 0])

activate_TrackProfile = 0
current_racetrack = "traj_ltpl_cl_LVMS_GPS.csv"