% Simulink data dictionary Berlin2018.sldd

Raceline = struct(
  s_m=[0; 0.4999964; 0.9999928; 1.4999891; 1.9999855; 2.4999819; 2.9999783; 3.4999747; 3.999971; 4.4999674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 2678],
  x_m=[97.8891914; 97.5325266; 97.1760671; 96.819813; 96.4637644; 96.1079213; 95.7522837; 95.3968517; 95.0416253; 94.6866046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 0],
  y_m=[153.5786109; 153.2282018; 152.8775837; 152.526757; 152.1757217; 151.8244782; 151.4730265; 151.1213669; 150.7694996; 150.4174248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 0],
  psi_rad=[2.3470541; 2.3476402; 2.348226; 2.3488116; 2.3493969; 2.349982; 2.3505669; 2.3511516; 2.3517361; 2.3523203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 0],
  kappa_radpm=[0.0011731; 0.0011723; 0.0011716; 0.001171; 0.0011705; 0.00117; 0.0011696; 0.0011692; 0.0011687; 0.0011683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 0],
  vx_mps=[40.1210046; 40.2042133; 40.2874219; 40.3706305; 40.4538365; 40.5361372; 40.6184379; 40.7007387; 40.7830341; 40.8644268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 0],
  ax_mps2=[6.7045501; 6.69987; 6.6951898; 6.6905097; 6.6858283; 6.6806975; 6.6755667; 6.6704359; 6.6653067; 6.6604516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 0],
  delta_rad=repmat(0, 5000, 1),
  F_N=repmat(0, 5000, 1),
  ValidPointCnt=4645,
  s_m_end=2321.9831857)

Raceline_Op1 = struct(
  s_m=[0; 0.4999964; 0.9999928; 1.4999891; 1.9999855; 2.4999819; 2.9999783; 3.4999747; 3.999971; 4.4999674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 2678],
  x_m=[97.8891914; 97.5325266; 97.1760671; 96.819813; 96.4637644; 96.1079213; 95.7522837; 95.3968517; 95.0416253; 94.6866046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 0],
  y_m=[153.5786109; 153.2282018; 152.8775837; 152.526757; 152.1757217; 151.8244782; 151.4730265; 151.1213669; 150.7694996; 150.4174248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 0],
  psi_rad=[2.3470541; 2.3476402; 2.348226; 2.3488116; 2.3493969; 2.349982; 2.3505669; 2.3511516; 2.3517361; 2.3523203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 0],
  kappa_radpm=[0.0011731; 0.0011723; 0.0011716; 0.001171; 0.0011705; 0.00117; 0.0011696; 0.0011692; 0.0011687; 0.0011683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 0],
  vx_mps=[40.1210046; 40.2042133; 40.2874219; 40.3706305; 40.4538365; 40.5361372; 40.6184379; 40.7007387; 40.7830341; 40.8644268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 0],
  ax_mps2=[6.7045501; 6.69987; 6.6951898; 6.6905097; 6.6858283; 6.6806975; 6.6755667; 6.6704359; 6.6653067; 6.6604516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 0],
  delta_rad=repmat(0, 5000, 1),
  F_N=repmat(0, 5000, 1),
  ValidPointCnt=4645,
  s_m_end=2321.9831857)

Raceline_Op2 = struct(
  s_m=[0; 0.4999964; 0.9999928; 1.4999891; 1.9999855; 2.4999819; 2.9999783; 3.4999747; 3.999971; 4.4999674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 2678],
  x_m=[97.8891914; 97.5325266; 97.1760671; 96.819813; 96.4637644; 96.1079213; 95.7522837; 95.3968517; 95.0416253; 94.6866046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 0],
  y_m=[153.5786109; 153.2282018; 152.8775837; 152.526757; 152.1757217; 151.8244782; 151.4730265; 151.1213669; 150.7694996; 150.4174248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 0],
  psi_rad=[2.3470541; 2.3476402; 2.348226; 2.3488116; 2.3493969; 2.349982; 2.3505669; 2.3511516; 2.3517361; 2.3523203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 0],
  kappa_radpm=[0.0011731; 0.0011723; 0.0011716; 0.001171; 0.0011705; 0.00117; 0.0011696; 0.0011692; 0.0011687; 0.0011683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 0],
  vx_mps=[40.1210046; 40.2042133; 40.2874219; 40.3706305; 40.4538365; 40.5361372; 40.6184379; 40.7007387; 40.7830341; 40.8644268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 0],
  ax_mps2=[6.7045501; 6.69987; 6.6951898; 6.6905097; 6.6858283; 6.6806975; 6.6755667; 6.6704359; 6.6653067; 6.6604516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 0],
  delta_rad=repmat(0, 5000, 1),
  F_N=repmat(0, 5000, 1),
  ValidPointCnt=4645,
  s_m_end=2321.9831857)

s0_m_Op1 = 0
s0_m_Op2 = 0
s0_m_Op3 = 0
s0_m_Op4 = 0
velGain_Op1 = 0
velGain_Op2 = 0
velGain_Op3 = 0
velGain_Op4 = 0
x0_vehiclepose = [97.8891914 153.5786109 2.3470541]
x0_vehiclepose_Op1 = [97.8891914 153.5786109 2.3470541]
x0_vehiclepose_Op2 = [97.8891914 153.5786109 2.3470541]
x0_vehiclepose_Op3 = [97.8891914 153.5786109 2.3470541]
x0_vehiclepose_Op4 = [97.8891914 153.5786109 2.3470541]