% Simulink data dictionary HongKong.sldd

Raceline = struct(
  s_m=[0; 0.3999896; 0.7999792; 1.1999688; 1.5999585; 1.9999481; 2.3999377; 2.7999273; 3.1999169; 3.5999065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 2221],
  x_m=[-42.3638373; -42.5348804; -42.717002; -42.9098371; -43.1130206; -43.3261876; -43.5489732; -43.7810123; -44.022028; -44.2716109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 0],
  y_m=[115.6036557; 115.9650706; 116.3210999; 116.6715234; 117.0161207; 117.3546715; 117.6869555; 118.0127523; 118.3319656; 118.6445323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 0],
  psi_rad=[0.4264989; 0.4570775; 0.4874768; 0.5174574; 0.5469141; 0.5758739; 0.604357; 0.6322727; 0.6595103; 0.6859504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 0],
  kappa_radpm=[0.0742426; 0.0742873; 0.0740274; 0.0734297; 0.0724921; 0.0712435; 0.0697216; 0.0679832; 0.066093; 0.0640888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 0],
  vx_mps=[10.8608828; 10.8844933; 10.9081039; 10.9317144; 10.955325; 10.9789963; 11.0435449; 11.1080936; 11.1726423; 11.237191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 0],
  ax_mps2=[0.6445783; 0.8752838; 1.1059894; 1.3366949; 1.5674004; 1.7979692; 1.9365295; 2.0750898; 2.21365; 2.3522103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 0],
  delta_rad=repmat(0, 5000, 1),
  F_N=repmat(0, 5000, 1),
  ValidPointCnt=4634,
  s_m_end=1853.1518883)

Raceline_Op1 = struct(
  s_m=[0; 0.3999896; 0.7999792; 1.1999688; 1.5999585; 1.9999481; 2.3999377; 2.7999273; 3.1999169; 3.5999065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 2221],
  x_m=[-42.3638373; -42.5348804; -42.717002; -42.9098371; -43.1130206; -43.3261876; -43.5489732; -43.7810123; -44.022028; -44.2716109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 0],
  y_m=[115.6036557; 115.9650706; 116.3210999; 116.6715234; 117.0161207; 117.3546715; 117.6869555; 118.0127523; 118.3319656; 118.6445323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 0],
  psi_rad=[0.4264989; 0.4570775; 0.4874768; 0.5174574; 0.5469141; 0.5758739; 0.604357; 0.6322727; 0.6595103; 0.6859504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 0],
  kappa_radpm=[0.0742426; 0.0742873; 0.0740274; 0.0734297; 0.0724921; 0.0712435; 0.0697216; 0.0679832; 0.066093; 0.0640888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 0],
  vx_mps=[10.8608828; 10.8844933; 10.9081039; 10.9317144; 10.955325; 10.9789963; 11.0435449; 11.1080936; 11.1726423; 11.237191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 0],
  ax_mps2=[0.6445783; 0.8752838; 1.1059894; 1.3366949; 1.5674004; 1.7979692; 1.9365295; 2.0750898; 2.21365; 2.3522103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 0],
  delta_rad=repmat(0, 5000, 1),
  F_N=repmat(0, 5000, 1),
  ValidPointCnt=4634,
  s_m_end=1853.1518883)

Raceline_Op2 = struct(
  s_m=[0; 0.3999896; 0.7999792; 1.1999688; 1.5999585; 1.9999481; 2.3999377; 2.7999273; 3.1999169; 3.5999065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 2221],
  x_m=[-42.3638373; -42.5348804; -42.717002; -42.9098371; -43.1130206; -43.3261876; -43.5489732; -43.7810123; -44.022028; -44.2716109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 0],
  y_m=[115.6036557; 115.9650706; 116.3210999; 116.6715234; 117.0161207; 117.3546715; 117.6869555; 118.0127523; 118.3319656; 118.6445323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 0],
  psi_rad=[0.4264989; 0.4570775; 0.4874768; 0.5174574; 0.5469141; 0.5758739; 0.604357; 0.6322727; 0.6595103; 0.6859504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 0],
  kappa_radpm=[0.0742426; 0.0742873; 0.0740274; 0.0734297; 0.0724921; 0.0712435; 0.0697216; 0.0679832; 0.066093; 0.0640888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 0],
  vx_mps=[10.8608828; 10.8844933; 10.9081039; 10.9317144; 10.955325; 10.9789963; 11.0435449; 11.1080936; 11.1726423; 11.237191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 0],
  ax_mps2=[0.6445783; 0.8752838; 1.1059894; 1.3366949; 1.5674004; 1.7979692; 1.9365295; 2.0750898; 2.21365; 2.3522103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 0],
  delta_rad=repmat(0, 5000, 1),
  F_N=repmat(0, 5000, 1),
  ValidPointCnt=4634,
  s_m_end=1853.1518883)

s0_m_Op1 = 0
s0_m_Op2 = 0
s0_m_Op3 = 0
s0_m_Op4 = 0
velGain_Op1 = 0
velGain_Op2 = 0
velGain_Op3 = 0
velGain_Op4 = 0
x0_vehiclepose = [-42.3638373 115.6036557 0.4264989]
x0_vehiclepose_Op1 = [-42.3638373 115.6036557 0.4264989]
x0_vehiclepose_Op2 = [-42.3638373 115.6036557 0.4264989]
x0_vehiclepose_Op3 = [-42.3638373 115.6036557 0.4264989]
x0_vehiclepose_Op4 = [-42.3638373 115.6036557 0.4264989]