% Simulink data dictionary frictionmaps.sldd

Grid_map_1 = int16([-100 600 20 0 0 0 0 0 0 0 0 0 0 0 0 0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
 -250 350 0 0 0 0 0 0 0 0 0 0 0 0 0 0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
 0 0 0 0 0 0 0 0 0 0 0 0 0 0 0 0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
 0 0 0 0 0 0 0 0 0 0 0 0 0 0 0 0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
 0 0 0 0 0 0 0 0 0 0 0 0 0 0 0 0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
 0 0 0 0 0 0 0 0 0 0 0 0 0 0 0 0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
 0 0 0 0 0 0 0 0 0 0 0 0 0 0 0 0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
 0 0 0 0 0 0 0 0 0 0 0 0 0 0 0 0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
 0 0 0 0 0 0 0 0 0 0 0 0 0 0 0 0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
 0 0 0 0 0 0 0 0 0 0 0 0 0 0 0 0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 ])

Grid_map_2 = int8(repmat(0, 3000, 3500))
Grid_map_3 = int8(repmat(0, 3000, 3500))
Grid_map_4 = int8(repmat(0, 3000, 3500))
InterpTime = [0; 0; 0; 0]
Gridmap_Ident = [-100 600 20; -250 350 0; 3000 3500 0]