% Simulink data dictionary PassengerVehicle.sldd
% references VDBS_PassVeh14DOF.sldd
% references FailureModesGen.sldd
% references vehicleparameters_vehdynsim.sldd
% references frictionmodel.sldd
% references racetrack.sldd

P_BrakeGain = 1
activate_VariableFriction = Simulink.Parameter(0, DataType="boolean")
P_PassengerVehicleSimModel = 2
P_Sim_Spacedrive_Breakpoints = [-10 -5 0 5 10 15 20 25 30 35]
P_Sim_SteeringAngleOffset_rad = Simulink.Parameter(0)
P_Sim_Spacedrive_Offfset = [0.0019 0.0014 0.0009 0.0004 -0.0001 -0.0006 -0.0011 -0.0016 -0.0021 -0.0026]
activate_Banking = 1