% Simulink data dictionary vehicleparameters_vehdynsim.sldd
% references simulation_modelconfig.sldd
% references simulation_interfaces.sldd
% references enginemap.sldd

VEH__VehicleData__m_Vehicle_kg = 750
VEH__VehicleData__l_WheelbaseF_m = 1.724
VEH__VehicleData__l_WheelbaseTotal_m = 2.971
VEH__VehicleData__w_GeomCenterlineToCOG_m = 0
VEH__VehicleData__h_AxlePlaneToCOG_m = 0
VEH__VehicleData__w_TrackF_m = 1.639
VEH__VehicleData__w_TrackR_m = 1.524
VEH__VehicleData__w_Vehicle_m = []
VEH__VehicleData__l_Vehicle_m = []
VEH__Aerodynamics__A_LongitudinalDrag_m2 = 1
VEH__Aerodynamics__cw_LongitudinalDrag = 0.725
VEH__Aerodynamics__cl_LongitudinalLift = -1.65
VEH__Aerodynamics__cpm_LongDragPitchMomentCoeff = 0.08
VEH__Aerodynamics__beta_wind_start_rad = 0
VEH__Aerodynamics__beta_wind_end_rad = 0.3
VEH__Aerodynamics__beta_wind_step_rad = 0.01
VEH__Aerodynamics__Cs_LatDragCoeff_start = 0
VEH__Aerodynamics__Cs_LatDragCoeff_end = 0.9
VEH__Aerodynamics__Cs_LatDragCoeff_step = 0.03
VEH__Aerodynamics__Cym_DragYawMomentCoeff_start = 0
VEH__Aerodynamics__Cym_DragYawMomentCoeff_end = 0.3
VEH__Aerodynamics__Cym_DragYawMomentCoeff_step = 0.01
VEH__Environment__p_Air_Pa = 101325
VEH__Environment__T_Air_K = 293.15
VEH__Environment__a_Gravity_mps2 = 9.81
VEH__Brakes__BrakeBias_Front = 0.5
VEH__Steering__T_Steering_s = 0.065
VEH__Steering__SteeringWheelAngleSensor_quantization = 0.000447
VEH__ActuatorLimitation__Fx_Throttle_max_N = 6000
VEH__ActuatorLimitation__Fx_Brake_max_N = -35000
VEH__ActuatorLimitation__deltaSteering_max_rad = 0.43
VEH__ActuatorLimitation__deltaSteering_min_rad = -0.43
VEH__Simulation__Sim_LongVelTolerance_mps = 0.01
VEH__Simulation__Sim_LongOff_m = 0
VEH__Simulation__Sim_LatOff_m = 0
VEH__Simulation__Sim_VertOff_m = 0
VEH__STMspecific__cLiftF = -0.522
VEH__STMspecific__cLiftR = -1.034
VEH__STMspecific__CoGz_m = 0.275
VEH__STMspecific__cRollFriction_Npmps = 200
VEH__STMspecific__MaxRollFriction_N = 200
VEH__STMspecific__T_YawRate_s = 0.15
VEH__STMspecific__T_LatVel_s = 0.15
VEH__STMspecific__T_Tire_s = 0.02
VEH__STMspecific__switchModelBlend_mps = 0.5
VEH__STMspecific__PTLimitLowVel_N = -500
VEH__STMspecific__switchModelVel_mps = 3
VEH__EngineData__Pmax_kW = 335
POWTR__MODE__activate_CombustionEngine = 1
POWTR__MODE__activate_ManualGearbox = 1
POWTR__MODE__activate_ThrottleInterface = 1
POWTR__LAYOUT__p_torque_rear = 1
POWTR__ENGINE__n_idle_rpm = 1600
POWTR__ENGINE__n_0_rpm = 1600
POWTR__ENGINE__n_limit_rpm = 7000
POWTR__ENGINE__I_engine_kgm2 = 0.2
POWTR__ENGINE__throttle_shiftbreak_s = 0.1
POWTR__CLUTCH__T_max_cap_Nm = 750
POWTR__CLUTCH__clutch_aggressiveness = 1
POWTR__CLUTCH__w_clutchengagement_start_rpm = 2000
POWTR__CLUTCH__w_clutchengagement_end_rpm = 2500
POWTR__TRANSMISSION__initial_gear = 0
POWTR__TRANSMISSION__I_transmission_kgm2 = 0.2
POWTR__DIFFERENTIAL__I_drivetrain_kgm2 = 2
POWTR__DIFFERENTIAL__c_diff_ratio = 3
POWTR__DIFFERENTIAL__c_diff_efficiency = 0.98
POWTR__DIFFERENTIAL__f_diff_ratio = 1
POWTR__DIFFERENTIAL__f_diff_efficiency = 0.99
POWTR__DIFFERENTIAL__r_diff_ratio = 1
POWTR__DIFFERENTIAL__r_diff_efficiency = 0.99
INIT__initialvalues__Vehicle_InitialRollAngle = 0
INIT__initialvalues__Vehicle_InitialPitchAngle = 0
INIT__initialvalues__Vehicle_InitialYawAngle = 0
INIT__initialvalues__Vehicle_InitialRollRate_radps = 0
INIT__initialvalues__Vehicle_InitialPitchRate_radps = 0
INIT__initialvalues__Vehicle_InitialYawRate_radps = 0
SUS__Compliance__Hmax_MaxHeightToHardblock_m = 0.5
SUS__Compliance__h_InertialFrameOffset_COGtoAxle_m = 0.134
SUS__Kinematics__k_ToeVSSteerF = 0
SUS__Kinematics__k_CasterVSSteerFrRe = 0
SUS__Kinematics__k_CamberVSSteerF = 0
SUS__Kinematics__k_HeightVSSteerF_mprad = 0.1432
tireFL__MFSIMPLE__PacLong_B = 18
tireFL__MFSIMPLE__PacLong_C = 2
tireFL__MFSIMPLE__PacLong_D = 1.7168
tireFL__MFSIMPLE__PacLong_E = 1
tireFL__MFSIMPLE__PacLong_Fznom = 3114
tireFL__MFSIMPLE__PacLong_eps_load = -0.289
tireFL__MFSIMPLE__PacLat_B = 10
tireFL__MFSIMPLE__PacLat_C = 1.603
tireFL__MFSIMPLE__PacLat_D = 1.654
tireFL__MFSIMPLE__PacLat_E = 1
tireFL__MFSIMPLE__PacLat_Fznom = 3114
tireFL__MFSIMPLE__PacLat_eps_load = -0.1783
tireFL__MFSIMPLE__r_tire_m = 0.3118
tireFL__MFSIMPLE__Iyy_Wheel_kgm2 = 1.35
tireFL__ANGLE = 1
tireFL__TYRESIDE = 1
tireFL__USE_MODE = 14
tireFL__LONGVL = 11
tireFL__INERTIAL__m_Wheel_kg = 15
tireFL__INERTIAL__Iyy_Wheel_kgm2 = 1.35
tireFL__WHEEL__br_Nmsprad = 0
tireFL__WHEEL__FNOMIN = 3114
tireFL__WHEEL__NORMPRES = 220000
tireFL__WHEEL__TYRE_RADIUS_MOD = 0.3118
tireFL__WHEEL__T_RelaxationLong = 3.5
tireFL__WHEEL__T_RelaxationLat = 1.5
tireFL__WHEEL__T_RelaxationMy = 100
tireFL__DIMENSION__UNLOADED_RADIUS = 0.3118
tireFL__DIMENSION__WIDTH = 0.295
tireFL__DIMENSION__ASPECT_RATIO = 0.3
tireFL__DIMENSION__RIM_RADIUS = 0.1651
tireFL__DIMENSION__RIM_WIDTH = 0.305
tireFL__VERTICAL__VERTICAL_STIFFNESS = 240000
tireFL__VERTICAL__VERTICAL_DAMPING = 100
tireFL__VERTICAL__BREFF = 3.0e-8
tireFL__VERTICAL__DREFF = 0
tireFL__VERTICAL__FREFF = 0
tireFL__VERTICAL__Q_RE0 = 1
tireFL__VERTICAL__Q_V1 = 0
tireFL__VERTICAL__Q_V2 = 0
tireFL__VERTICAL__Q_FZ1 = 25.36
tireFL__VERTICAL__Q_FZ2 = 0
tireFL__VERTICAL__Q_FZ3 = 0
tireFL__VERTICAL__Q_FCX = 0
tireFL__VERTICAL__Q_FCY = 0
tireFL__VERTICAL__Q_FCY2 = 0
tireFL__VERTICAL__PFZ1 = 0
tireFL__SIMULATION__KPUMIN = -1.5
tireFL__SIMULATION__KPUMAX = 1.5
tireFL__SIMULATION__ALPMIN = -1.5708
tireFL__SIMULATION__ALPMAX = 1.5708
tireFL__SIMULATION__CAMMIN = -0.3147
tireFL__SIMULATION__CAMMAX = 0.3147
tireFL__SIMULATION__FZMIN = 1
tireFL__SIMULATION__FZMAX = 20000
tireFL__SIMULATION__LONGVL = 11
tireFL__SIMULATION__VXLOW = 1
tireFL__SIMULATION__PRESMIN = 10000
tireFL__SIMULATION__PRESMAX = 1000000
tireFL__SCALING__LFZO = 1
tireFL__SCALING__LCX = 1
tireFL__SCALING__LMUX = 1
tireFL__SCALING__LEX = 1
tireFL__SCALING__LKX = 1
tireFL__SCALING__LHX = 1
tireFL__SCALING__LVX = 1
tireFL__SCALING__LGAX = 0
tireFL__SCALING__LCY = 1
tireFL__SCALING__LMUY = 1
tireFL__SCALING__LEY = 1
tireFL__SCALING__LKY = 1
tireFL__SCALING__LHY = 1
tireFL__SCALING__LVY = 1
tireFL__SCALING__LGAY = 0
tireFL__SCALING__LTR = 1
tireFL__SCALING__LRES = 1
tireFL__SCALING__LGAZ = 0
tireFL__SCALING__LXAL = 1
tireFL__SCALING__LYKA = 1
tireFL__SCALING__LVYKA = 1
tireFL__SCALING__LS = 1
tireFL__SCALING__LSGKP = 0
tireFL__SCALING__LSGAL = 0
tireFL__SCALING__LGYR = 0
tireFL__SCALING__LMX = 1
tireFL__SCALING__LVMX = 1
tireFL__SCALING__LMY = 1
tireFL__SCALING__LMUV = 0
tireFL__SCALING__LCZ = 1
tireFL__SCALING__LMPHI = 1
tireFL__LONGITUDINAL__PCX1 = 2
tireFL__LONGITUDINAL__PDX1 = 1.7168
tireFL__LONGITUDINAL__PDX2 = -0.289
tireFL__LONGITUDINAL__PDX3 = 0
tireFL__LONGITUDINAL__PEX1 = 0.6975
tireFL__LONGITUDINAL__PEX2 = 0.20123
tireFL__LONGITUDINAL__PEX3 = 0
tireFL__LONGITUDINAL__PEX4 = 0
tireFL__LONGITUDINAL__PKX1 = 63.75
tireFL__LONGITUDINAL__PKX2 = -15
tireFL__LONGITUDINAL__PKX3 = 0.2891
tireFL__LONGITUDINAL__PHX1 = -0.00058
tireFL__LONGITUDINAL__PHX2 = 0.00079
tireFL__LONGITUDINAL__PVX1 = 0
tireFL__LONGITUDINAL__PVX2 = 0
tireFL__LONGITUDINAL__RBX1 = 17.406
tireFL__LONGITUDINAL__RBX2 = 18.243
tireFL__LONGITUDINAL__RCX1 = 0.7119
tireFL__LONGITUDINAL__REX1 = -10
tireFL__LONGITUDINAL__REX2 = 3.9185
tireFL__LONGITUDINAL__RHX1 = 0.00211
tireFL__LONGITUDINAL__PTX1 = 0
tireFL__LONGITUDINAL__PTX2 = 0
tireFL__LONGITUDINAL__PTX3 = 0
tireFL__LONGITUDINAL__PPX1 = 0
tireFL__LONGITUDINAL__PPX2 = 0
tireFL__LONGITUDINAL__PPX3 = 0
tireFL__LONGITUDINAL__PPX4 = 0

tireFL__LONGITUDINAL__RBX3 = 0
tireFL__OVERTURNING__QSX1 = 0
tireFL__OVERTURNING__QSX2 = 0
tireFL__OVERTURNING__QSX3 = 0
tireFL__OVERTURNING__QSX4 = 0
tireFL__OVERTURNING__QSX5 = 0
tireFL__OVERTURNING__QSX6 = 0
tireFL__OVERTURNING__QSX7 = 0
tireFL__OVERTURNING__QSX8 = 0
tireFL__OVERTURNING__QSX9 = 0
tireFL__OVERTURNING__QSX10 = 0
tireFL__OVERTURNING__QSX11 = 0
tireFL__OVERTURNING__QSX12 = 0
tireFL__OVERTURNING__QSX13 = 0
tireFL__OVERTURNING__QSX14 = 0
tireFL__OVERTURNING__PPMX1 = 0
tireFL__LATERAL__PCY1 = 1.603
tireFL__LATERAL__PDY1 = 1.654
tireFL__LATERAL__PDY2 = -0.1783
tireFL__LATERAL__PDY3 = 0
tireFL__LATERAL__PEY1 = -1.409
tireFL__LATERAL__PEY2 = -1.6617
tireFL__LATERAL__PEY3 = 0.26886
tireFL__LATERAL__PEY4 = -13.61
tireFL__LATERAL__PKY1 = -53.05
tireFL__LATERAL__PKY2 = 4.1265
tireFL__LATERAL__PKY3 = 1.5016
tireFL__LATERAL__PHY1 = 0.0039
tireFL__LATERAL__PHY2 = -0.00253
tireFL__LATERAL__PHY3 = 0
tireFL__LATERAL__PVY1 = -0.01038
tireFL__LATERAL__PVY2 = -0.1
tireFL__LATERAL__PVY3 = 0.4498
tireFL__LATERAL__PVY4 = -1.5
tireFL__LATERAL__RBY1 = 35.304
tireFL__LATERAL__RBY2 = 15.666
tireFL__LATERAL__RBY3 = -0.01179
tireFL__LATERAL__RCY1 = 1.018
tireFL__LATERAL__REY1 = 0.35475
tireFL__LATERAL__REY2 = 0.01966
tireFL__LATERAL__RHY1 = 0.00667
tireFL__LATERAL__RHY2 = 0.00207
tireFL__LATERAL__RVY1 = 0.0426
tireFL__LATERAL__RVY2 = 0.03077
tireFL__LATERAL__RVY3 = 0.37305
tireFL__LATERAL__RVY4 = 100
tireFL__LATERAL__RVY5 = 2.2
tireFL__LATERAL__RVY6 = 25
tireFL__LATERAL__PTY1 = 0
tireFL__LATERAL__PTY2 = 0
tireFL__LATERAL__PEY5 = 0
tireFL__LATERAL__PKY4 = 2
tireFL__LATERAL__PKY5 = 0
tireFL__LATERAL__PKY6 = 0
tireFL__LATERAL__PKY7 = 0
tireFL__LATERAL__PPY1 = 0
tireFL__LATERAL__PPY2 = 0
tireFL__LATERAL__PPY3 = 0
tireFL__LATERAL__PPY4 = 0
tireFL__LATERAL__PPY5 = 0
tireFL__LATERAL__RBY4 = 0
tireFL__ROLLING__QSY1 = 0.015
tireFL__ROLLING__QSY2 = 0
tireFL__ROLLING__QSY3 = 0
tireFL__ROLLING__QSY4 = 0
tireFL__ROLLING__QSY5 = 0
tireFL__ROLLING__QSY6 = 0
tireFL__ROLLING__QSY7 = 1
tireFL__ROLLING__QSY8 = 0
tireFL__ALIGNING__QBZ1 = 12.457
tireFL__ALIGNING__QBZ2 = -0.04661
tireFL__ALIGNING__QBZ3 = 0
tireFL__ALIGNING__QBZ4 = 5.096
tireFL__ALIGNING__QBZ5 = 4.664
tireFL__ALIGNING__QBZ9 = 6.924
tireFL__ALIGNING__QBZ10 = 0
tireFL__ALIGNING__QCZ1 = 1.6
tireFL__ALIGNING__QDZ1 = 0.11496
tireFL__ALIGNING__QDZ2 = 0.00542
tireFL__ALIGNING__QDZ3 = 1.5
tireFL__ALIGNING__QDZ4 = 0
tireFL__ALIGNING__QDZ6 = -0.00023
tireFL__ALIGNING__QDZ7 = -0.02192
tireFL__ALIGNING__QDZ8 = -1.3554
tireFL__ALIGNING__QDZ9 = 0.119
tireFL__ALIGNING__QEZ1 = -10
tireFL__ALIGNING__QEZ2 = 5.742
tireFL__ALIGNING__QEZ3 = 0
tireFL__ALIGNING__QEZ4 = 1.3084
tireFL__ALIGNING__QEZ5 = 1.2514
tireFL__ALIGNING__QHZ1 = 0.01552
tireFL__ALIGNING__QHZ2 = -0.00917
tireFL__ALIGNING__QHZ3 = -0.07129
tireFL__ALIGNING__QHZ4 = 0.03423
tireFL__ALIGNING__SSZ1 = -0.09916
tireFL__ALIGNING__SSZ2 = 0.02588
tireFL__ALIGNING__SSZ3 = 2.2703
tireFL__ALIGNING__SSZ4 = -1.8657
tireFL__ALIGNING__QTZ1 = 0
tireFL__ALIGNING__MBELT = 0
tireFL__ALIGNING__QBZ6 = 0
tireFL__ALIGNING__QDZ10 = 0
tireFL__ALIGNING__QDZ11 = 0
tireFL__ALIGNING__PPZ1 = 0
tireFL__ALIGNING__PPZ2 = 0
tireFL__TURNSLIP__PDXP1 = 0.4
tireFL__TURNSLIP__PDXP2 = 0
tireFL__TURNSLIP__PDXP3 = 0
tireFL__TURNSLIP__PKYP1 = 1
tireFL__TURNSLIP__PDYP1 = 0.4
tireFL__TURNSLIP__PDYP2 = 0
tireFL__TURNSLIP__PDYP3 = 0
tireFL__TURNSLIP__PDYP4 = 0
tireFL__TURNSLIP__PHYP1 = 1
tireFL__TURNSLIP__PHYP2 = 0.15
tireFL__TURNSLIP__PHYP3 = 0
tireFL__TURNSLIP__PHYP4 = -4
tireFL__TURNSLIP__PECP1 = 0.5
tireFL__TURNSLIP__PECP2 = 0
tireFL__TURNSLIP__QDTP1 = 10
tireFL__TURNSLIP__QCRP1 = 0.2
tireFL__TURNSLIP__QCRP2 = 0.1
tireFL__TURNSLIP__QBRP1 = 0.1
tireFL__TURNSLIP__QDRP1 = 1
tireFL__TURNSLIP__QDRP2 = 0
tireFL__CONTACTPATCH__Q_RA1 = 0
tireFL__CONTACTPATCH__Q_RA2 = 0
tireFL__CONTACTPATCH__Q_RB1 = 0
tireFL__CONTACTPATCH__Q_RB2 = 0
tireFL__CONTACTPATCH__k1_TireFB_PT1 = 0.002
tireFL__CONTACTPATCH__k1_WheelsFB_PT1 = 0.002
tireFL__CONTACTPATCH__k2_TireFB_PT1 = 0.002
tireFL__CONTACTPATCH__p_Tires_Pa = 220000
tireFL__STRUCTURAL__LONGITUDINAL_STIFFNESS = 480000
tireFL__STRUCTURAL__LATERAL_STIFFNESS = 120000
tireFL__STRUCTURAL__PCFX1 = 0
tireFL__STRUCTURAL__PCFX2 = 0
tireFL__STRUCTURAL__PCFX3 = 0
tireFL__STRUCTURAL__PCFY1 = 0
tireFL__STRUCTURAL__PCFY2 = 0
tireFL__STRUCTURAL__PCFY3 = 0
tireFR__MFSIMPLE__PacLong_B = 18
tireFR__MFSIMPLE__PacLong_C = 2
tireFR__MFSIMPLE__PacLong_D = 1.7168
tireFR__MFSIMPLE__PacLong_E = 1
tireFR__MFSIMPLE__PacLong_Fznom = 3114
tireFR__MFSIMPLE__PacLong_eps_load = -0.289
tireFR__MFSIMPLE__PacLat_B = 10
tireFR__MFSIMPLE__PacLat_C = 1.603
tireFR__MFSIMPLE__PacLat_D = 1.654
tireFR__MFSIMPLE__PacLat_E = 1
tireFR__MFSIMPLE__PacLat_Fznom = 3114
tireFR__MFSIMPLE__PacLat_eps_load = -0.1783
tireFR__MFSIMPLE__r_tire_m = 0.3118
tireFR__MFSIMPLE__Iyy_Wheel_kgm2 = 1.35
tireFR__ANGLE = 1
tireFR__TYRESIDE = -1
tireFR__USE_MODE = 14
tireFR__LONGVL = 11
tireFR__INERTIAL__m_Wheel_kg = 15
tireFR__INERTIAL__Iyy_Wheel_kgm2 = 1.35
tireFR__WHEEL__br_Nmsprad = 0
tireFR__WHEEL__FNOMIN = 3114
tireFR__WHEEL__NORMPRES = 220000
tireFR__WHEEL__TYRE_RADIUS_MOD = 0.3118
tireFR__WHEEL__T_RelaxationLong = 3.5
tireFR__WHEEL__T_RelaxationLat = 1.5
tireFR__WHEEL__T_RelaxationMy = 100
tireFR__DIMENSION__UNLOADED_RADIUS = 0.3118
tireFR__DIMENSION__WIDTH = 0.295
tireFR__DIMENSION__ASPECT_RATIO = 0.3
tireFR__DIMENSION__RIM_RADIUS = 0.1651
tireFR__DIMENSION__RIM_WIDTH = 0.305
tireFR__VERTICAL__VERTICAL_STIFFNESS = 240000
tireFR__VERTICAL__VERTICAL_DAMPING = 100
tireFR__VERTICAL__BREFF = 3.0e-8
tireFR__VERTICAL__DREFF = 0
tireFR__VERTICAL__FREFF = 0
tireFR__VERTICAL__Q_RE0 = 1
tireFR__VERTICAL__Q_V1 = 0
tireFR__VERTICAL__Q_V2 = 0
tireFR__VERTICAL__Q_FZ1 = 25.36
tireFR__VERTICAL__Q_FZ2 = 0
tireFR__VERTICAL__Q_FZ3 = 0
tireFR__VERTICAL__Q_FCX = 0
tireFR__VERTICAL__Q_FCY = 0
tireFR__VERTICAL__Q_FCY2 = 0
tireFR__VERTICAL__PFZ1 = 0
tireFR__SIMULATION__KPUMIN = -1.5
tireFR__SIMULATION__KPUMAX = 1.5
tireFR__SIMULATION__ALPMIN = -1.5708
tireFR__SIMULATION__ALPMAX = 1.5708
tireFR__SIMULATION__CAMMIN = -0.3147
tireFR__SIMULATION__CAMMAX = 0.3147
tireFR__SIMULATION__FZMIN = 1
tireFR__SIMULATION__FZMAX = 20000
tireFR__SIMULATION__LONGVL = 11
tireFR__SIMULATION__VXLOW = 1
tireFR__SIMULATION__PRESMIN = 10000
tireFR__SIMULATION__PRESMAX = 1000000

tireFR__SCALING__LFZO = 1
tireFR__SCALING__LCX = 1
tireFR__SCALING__LMUX = 1
tireFR__SCALING__LEX = 1
tireFR__SCALING__LKX = 1
tireFR__SCALING__LHX = 1
tireFR__SCALING__LVX = 1
tireFR__SCALING__LGAX = 0
tireFR__SCALING__LCY = 1
tireFR__SCALING__LMUY = 1
tireFR__SCALING__LEY = 1
tireFR__SCALING__LKY = 1
tireFR__SCALING__LHY = 1
tireFR__SCALING__LVY = 1
tireFR__SCALING__LGAY = 0
tireFR__SCALING__LTR = 1
tireFR__SCALING__LRES = 1
tireFR__SCALING__LGAZ = 0
tireFR__SCALING__LXAL = 1
tireFR__SCALING__LYKA = 1
tireFR__SCALING__LVYKA = 1
tireFR__SCALING__LS = 1
tireFR__SCALING__LSGKP = 0
tireFR__SCALING__LSGAL = 0
tireFR__SCALING__LGYR = 0
tireFR__SCALING__LMX = 1
tireFR__SCALING__LVMX = 1
tireFR__SCALING__LMY = 1
tireFR__SCALING__LMUV = 0
tireFR__SCALING__LCZ = 1
tireFR__SCALING__LMPHI = 1
tireFR__LONGITUDINAL__PCX1 = 2
tireFR__LONGITUDINAL__PDX1 = 1.7168
tireFR__LONGITUDINAL__PDX2 = -0.289
tireFR__LONGITUDINAL__PDX3 = 0
tireFR__LONGITUDINAL__PEX1 = 0.6975
tireFR__LONGITUDINAL__PEX2 = 0.20123
tireFR__LONGITUDINAL__PEX3 = 0
tireFR__LONGITUDINAL__PEX4 = 0
tireFR__LONGITUDINAL__PKX1 = 63.75
tireFR__LONGITUDINAL__PKX2 = -15
tireFR__LONGITUDINAL__PKX3 = 0.2891
tireFR__LONGITUDINAL__PHX1 = -0.00058
tireFR__LONGITUDINAL__PHX2 = 0.00079
tireFR__LONGITUDINAL__PVX1 = 0
tireFR__LONGITUDINAL__PVX2 = 0
tireFR__LONGITUDINAL__RBX1 = 17.406
tireFR__LONGITUDINAL__RBX2 = 18.243
tireFR__LONGITUDINAL__RCX1 = 0.7119
tireFR__LONGITUDINAL__REX1 = -10
tireFR__LONGITUDINAL__REX2 = 3.9185
tireFR__LONGITUDINAL__RHX1 = 0.00211
tireFR__LONGITUDINAL__PTX1 = 0
tireFR__LONGITUDINAL__PTX2 = 0
tireFR__LONGITUDINAL__PTX3 = 0
tireFR__LONGITUDINAL__PPX1 = 0
tireFR__LONGITUDINAL__PPX2 = 0
tireFR__LONGITUDINAL__PPX3 = 0
tireFR__LONGITUDINAL__PPX4 = 0
tireFR__LONGITUDINAL__RBX3 = 0
tireFR__OVERTURNING__QSX1 = 0
tireFR__OVERTURNING__QSX2 = 0
tireFR__OVERTURNING__QSX3 = 0
tireFR__OVERTURNING__QSX4 = 0
tireFR__OVERTURNING__QSX5 = 0
tireFR__OVERTURNING__QSX6 = 0
tireFR__OVERTURNING__QSX7 = 0
tireFR__OVERTURNING__QSX8 = 0
tireFR__OVERTURNING__QSX9 = 0
tireFR__OVERTURNING__QSX10 = 0
tireFR__OVERTURNING__QSX11 = 0
tireFR__OVERTURNING__QSX12 = 0
tireFR__OVERTURNING__QSX13 = 0
tireFR__OVERTURNING__QSX14 = 0
tireFR__OVERTURNING__PPMX1 = 0
tireFR__LATERAL__PCY1 = 1.603
tireFR__LATERAL__PDY1 = 1.654
tireFR__LATERAL__PDY2 = -0.1783
tireFR__LATERAL__PDY3 = 0
tireFR__LATERAL__PEY1 = -1.409
tireFR__LATERAL__PEY2 = -1.6617
tireFR__LATERAL__PEY3 = 0.26886
tireFR__LATERAL__PEY4 = -13.61
tireFR__LATERAL__PKY1 = -53.05
tireFR__LATERAL__PKY2 = 4.1265
tireFR__LATERAL__PKY3 = 1.5016
tireFR__LATERAL__PHY1 = 0.0039
tireFR__LATERAL__PHY2 = -0.00253
tireFR__LATERAL__PHY3 = 0
tireFR__LATERAL__PVY1 = -0.01038
tireFR__LATERAL__PVY2 = -0.1
tireFR__LATERAL__PVY3 = 0.4498
tireFR__LATERAL__PVY4 = -1.5
tireFR__LATERAL__RBY1 = 35.304
tireFR__LATERAL__RBY2 = 15.666
tireFR__LATERAL__RBY3 = -0.01179
tireFR__LATERAL__RCY1 = 1.018
tireFR__LATERAL__REY1 = 0.35475
tireFR__LATERAL__REY2 = 0.01966
tireFR__LATERAL__RHY1 = 0.00667
tireFR__LATERAL__RHY2 = 0.00207
tireFR__LATERAL__RVY1 = 0.0426
tireFR__LATERAL__RVY2 = 0.03077
tireFR__LATERAL__RVY3 = 0.37305
tireFR__LATERAL__RVY4 = 100
tireFR__LATERAL__RVY5 = 2.2
tireFR__LATERAL__RVY6 = 25
tireFR__LATERAL__PTY1 = 0
tireFR__LATERAL__PTY2 = 0
tireFR__LATERAL__PEY5 = 0
tireFR__LATERAL__PKY4 = 2
tireFR__LATERAL__PKY5 = 0
tireFR__LATERAL__PKY6 = 0
tireFR__LATERAL__PKY7 = 0
tireFR__LATERAL__PPY1 = 0
tireFR__LATERAL__PPY2 = 0
tireFR__LATERAL__PPY3 = 0
tireFR__LATERAL__PPY4 = 0
tireFR__LATERAL__PPY5 = 0
tireFR__LATERAL__RBY4 = 0
tireFR__ROLLING__QSY1 = 0.015
tireFR__ROLLING__QSY2 = 0
tireFR__ROLLING__QSY3 = 0
tireFR__ROLLING__QSY4 = 0
tireFR__ROLLING__QSY5 = 0
tireFR__ROLLING__QSY6 = 0
tireFR__ROLLING__QSY7 = 1
tireFR__ROLLING__QSY8 = 0
tireFR__ALIGNING__QBZ1 = 12.457
tireFR__ALIGNING__QBZ2 = -0.04661
tireFR__ALIGNING__QBZ3 = 0
tireFR__ALIGNING__QBZ4 = 5.096
tireFR__ALIGNING__QBZ5 = 4.664
tireFR__ALIGNING__QBZ9 = 6.924
tireFR__ALIGNING__QBZ10 = 0
tireFR__ALIGNING__QCZ1 = 1.6
tireFR__ALIGNING__QDZ1 = 0.11496
tireFR__ALIGNING__QDZ2 = 0.00542
tireFR__ALIGNING__QDZ3 = 1.5
tireFR__ALIGNING__QDZ4 = 0
tireFR__ALIGNING__QDZ6 = -0.00023
tireFR__ALIGNING__QDZ7 = -0.02192
tireFR__ALIGNING__QDZ8 = -1.3554
tireFR__ALIGNING__QDZ9 = 0.119
tireFR__ALIGNING__QEZ1 = -10
tireFR__ALIGNING__QEZ2 = 5.742
tireFR__ALIGNING__QEZ3 = 0
tireFR__ALIGNING__QEZ4 = 1.3084
tireFR__ALIGNING__QEZ5 = 1.2514
tireFR__ALIGNING__QHZ1 = 0.01552
tireFR__ALIGNING__QHZ2 = -0.00917
tireFR__ALIGNING__QHZ3 = -0.07129
tireFR__ALIGNING__QHZ4 = 0.03423
tireFR__ALIGNING__SSZ1 = -0.09916
tireFR__ALIGNING__SSZ2 = 0.02588
tireFR__ALIGNING__SSZ3 = 2.2703
tireFR__ALIGNING__SSZ4 = -1.8657
tireFR__ALIGNING__QTZ1 = 0
tireFR__ALIGNING__MBELT = 0
tireFR__ALIGNING__QBZ6 = 0
tireFR__ALIGNING__QDZ10 = 0
tireFR__ALIGNING__QDZ11 = 0
tireFR__ALIGNING__PPZ1 = 0
tireFR__ALIGNING__PPZ2 = 0
tireFR__TURNSLIP__PDXP1 = 0.4
tireFR__TURNSLIP__PDXP2 = 0
tireFR__TURNSLIP__PDXP3 = 0
tireFR__TURNSLIP__PKYP1 = 1
tireFR__TURNSLIP__PDYP1 = 0.4
tireFR__TURNSLIP__PDYP2 = 0
tireFR__TURNSLIP__PDYP3 = 0
tireFR__TURNSLIP__PDYP4 = 0
tireFR__TURNSLIP__PHYP1 = 1
tireFR__TURNSLIP__PHYP2 = 0.15
tireFR__TURNSLIP__PHYP3 = 0
tireFR__TURNSLIP__PHYP4 = -4
tireFR__TURNSLIP__PECP1 = 0.5
tireFR__TURNSLIP__PECP2 = 0
tireFR__TURNSLIP__QDTP1 = 10
tireFR__TURNSLIP__QCRP1 = 0.2
tireFR__TURNSLIP__QCRP2 = 0.1
tireFR__TURNSLIP__QBRP1 = 0.1
tireFR__TURNSLIP__QDRP1 = 1
tireFR__TURNSLIP__QDRP2 = 0
tireFR__CONTACTPATCH__Q_RA1 = 0
tireFR__CONTACTPATCH__Q_RA2 = 0
tireFR__CONTACTPATCH__Q_RB1 = 0
tireFR__CONTACTPATCH__Q_RB2 = 0
tireFR__CONTACTPATCH__k1_TireFB_PT1 = 0.002
tireFR__CONTACTPATCH__k1_WheelsFB_PT1 = 0.002
tireFR__CONTACTPATCH__k2_TireFB_PT1 = 0.002
tireFR__CONTACTPATCH__p_Tires_Pa = 220000
tireFR__STRUCTURAL__LONGITUDINAL_STIFFNESS = 480000
tireFR__STRUCTURAL__LATERAL_STIFFNESS = 120000
tireFR__STRUCTURAL__PCFX1 = 0
tireFR__STRUCTURAL__PCFX2 = 0
tireFR__STRUCTURAL__PCFX3 = 0
tireFR__STRUCTURAL__PCFY1 = 0
tireFR__STRUCTURAL__PCFY2 = 0
tireFR__STRUCTURAL__PCFY3 = 0

tireRL__MFSIMPLE__PacLong_B = 18
tireRL__MFSIMPLE__PacLong_C = 2
tireRL__MFSIMPLE__PacLong_D = 1.7168
tireRL__MFSIMPLE__PacLong_E = 1
tireRL__MFSIMPLE__PacLong_Fznom = 3114
tireRL__MFSIMPLE__PacLong_eps_load = -0.289
tireRL__MFSIMPLE__PacLat_B = 10
tireRL__MFSIMPLE__PacLat_C = 1.603
tireRL__MFSIMPLE__PacLat_D = 1.654
tireRL__MFSIMPLE__PacLat_E = 1
tireRL__MFSIMPLE__PacLat_Fznom = 3114
tireRL__MFSIMPLE__PacLat_eps_load = -0.1783
tireRL__MFSIMPLE__r_tire_m = 0.3118
tireRL__MFSIMPLE__Iyy_Wheel_kgm2 = 1.35
tireRL__ANGLE = 1
tireRL__TYRESIDE = 1
tireRL__USE_MODE = 14
tireRL__LONGVL = 11
tireRL__INERTIAL__m_Wheel_kg = 15
tireRL__INERTIAL__Iyy_Wheel_kgm2 = 1.35
tireRL__WHEEL__br_Nmsprad = 0
tireRL__WHEEL__FNOMIN = 3114
tireRL__WHEEL__NORMPRES = 220000
tireRL__WHEEL__TYRE_RADIUS_MOD = 0.3118
tireRL__WHEEL__T_RelaxationLong = 3.5
tireRL__WHEEL__T_RelaxationLat = 1.5
tireRL__WHEEL__T_RelaxationMy = 100
tireRL__DIMENSION__UNLOADED_RADIUS = 0.3118
tireRL__DIMENSION__WIDTH = 0.295
tireRL__DIMENSION__ASPECT_RATIO = 0.3
tireRL__DIMENSION__RIM_RADIUS = 0.1651
tireRL__DIMENSION__RIM_WIDTH = 0.305
tireRL__VERTICAL__VERTICAL_STIFFNESS = 240000
tireRL__VERTICAL__VERTICAL_DAMPING = 100
tireRL__VERTICAL__BREFF = 3.0e-8
tireRL__VERTICAL__DREFF = 0
tireRL__VERTICAL__FREFF = 0
tireRL__VERTICAL__Q_RE0 = 1
tireRL__VERTICAL__Q_V1 = 0
tireRL__VERTICAL__Q_V2 = 0
tireRL__VERTICAL__Q_FZ1 = 25.36
tireRL__VERTICAL__Q_FZ2 = 0
tireRL__VERTICAL__Q_FZ3 = 0
tireRL__VERTICAL__Q_FCX = 0
tireRL__VERTICAL__Q_FCY = 0
tireRL__VERTICAL__Q_FCY2 = 0
tireRL__VERTICAL__PFZ1 = 0
tireRL__SIMULATION__KPUMIN = -1.5
tireRL__SIMULATION__KPUMAX = 1.5
tireRL__SIMULATION__ALPMIN = -1.5708
tireRL__SIMULATION__ALPMAX = 1.5708
tireRL__SIMULATION__CAMMIN = -0.3147
tireRL__SIMULATION__CAMMAX = 0.3147
tireRL__SIMULATION__FZMIN = 1
tireRL__SIMULATION__FZMAX = 20000
tireRL__SIMULATION__LONGVL = 11
tireRL__SIMULATION__VXLOW = 1
tireRL__SIMULATION__PRESMIN = 10000
tireRL__SIMULATION__PRESMAX = 1000000
tireRL__SCALING__LFZO = 1
tireRL__SCALING__LCX = 1
tireRL__SCALING__LMUX = 1
tireRL__SCALING__LEX = 1
tireRL__SCALING__LKX = 1
tireRL__SCALING__LHX = 1
tireRL__SCALING__LVX = 1
tireRL__SCALING__LGAX = 0
tireRL__SCALING__LCY = 1
tireRL__SCALING__LMUY = 1
tireRL__SCALING__LEY = 1
tireRL__SCALING__LKY = 1
tireRL__SCALING__LHY = 1
tireRL__SCALING__LVY = 1
tireRL__SCALING__LGAY = 0
tireRL__SCALING__LTR = 1
tireRL__SCALING__LRES = 1
tireRL__SCALING__LGAZ = 0
tireRL__SCALING__LXAL = 1
tireRL__SCALING__LYKA = 1
tireRL__SCALING__LVYKA = 1
tireRL__SCALING__LS = 1
tireRL__SCALING__LSGKP = 0
tireRL__SCALING__LSGAL = 0
tireRL__SCALING__LGYR = 0
tireRL__SCALING__LMX = 1
tireRL__SCALING__LVMX = 1
tireRL__SCALING__LMY = 1
tireRL__SCALING__LMUV = 0
tireRL__SCALING__LCZ = 1
tireRL__SCALING__LMPHI = 1
tireRL__LONGITUDINAL__PCX1 = 2
tireRL__LONGITUDINAL__PDX1 = 1.7168
tireRL__LONGITUDINAL__PDX2 = -0.289
tireRL__LONGITUDINAL__PDX3 = 0
tireRL__LONGITUDINAL__PEX1 = 0.6975
tireRL__LONGITUDINAL__PEX2 = 0.20123
tireRL__LONGITUDINAL__PEX3 = 0
tireRL__LONGITUDINAL__PEX4 = 0
tireRL__LONGITUDINAL__PKX1 = 63.75
tireRL__LONGITUDINAL__PKX2 = -15
tireRL__LONGITUDINAL__PKX3 = 0.2891
tireRL__LONGITUDINAL__PHX1 = -0.00058
tireRL__LONGITUDINAL__PHX2 = 0.00079
tireRL__LONGITUDINAL__PVX1 = 0
tireRL__LONGITUDINAL__PVX2 = 0
tireRL__LONGITUDINAL__RBX1 = 17.406
tireRL__LONGITUDINAL__RBX2 = 18.243
tireRL__LONGITUDINAL__RCX1 = 0.7119
tireRL__LONGITUDINAL__REX1 = -10
tireRL__LONGITUDINAL__REX2 = 3.9185
tireRL__LONGITUDINAL__RHX1 = 0.00211
tireRL__LONGITUDINAL__PTX1 = 0
tireRL__LONGITUDINAL__PTX2 = 0
tireRL__LONGITUDINAL__PTX3 = 0
tireRL__LONGITUDINAL__PPX1 = 0
tireRL__LONGITUDINAL__PPX2 = 0
tireRL__LONGITUDINAL__PPX3 = 0
tireRL__LONGITUDINAL__PPX4 = 0
tireRL__LONGITUDINAL__RBX3 = 0
tireRL__OVERTURNING__QSX1 = 0
tireRL__OVERTURNING__QSX2 = 0
tireRL__OVERTURNING__QSX3 = 0
tireRL__OVERTURNING__QSX4 = 0
tireRL__OVERTURNING__QSX5 = 0
tireRL__OVERTURNING__QSX6 = 0
tireRL__OVERTURNING__QSX7 = 0
tireRL__OVERTURNING__QSX8 = 0
tireRL__OVERTURNING__QSX9 = 0
tireRL__OVERTURNING__QSX10 = 0
tireRL__OVERTURNING__QSX11 = 0
tireRL__OVERTURNING__QSX12 = 0
tireRL__OVERTURNING__QSX13 = 0
tireRL__OVERTURNING__QSX14 = 0
tireRL__OVERTURNING__PPMX1 = 0
tireRL__LATERAL__PCY1 = 1.603
tireRL__LATERAL__PDY1 = 1.654
tireRL__LATERAL__PDY2 = -0.1783
tireRL__LATERAL__PDY3 = 0
tireRL__LATERAL__PEY1 = -1.409
tireRL__LATERAL__PEY2 = -1.6617
tireRL__LATERAL__PEY3 = 0.26886
tireRL__LATERAL__PEY4 = -13.61
tireRL__LATERAL__PKY1 = -53.05
tireRL__LATERAL__PKY2 = 4.1265
tireRL__LATERAL__PKY3 = 1.5016
tireRL__LATERAL__PHY1 = 0.0039
tireRL__LATERAL__PHY2 = -0.00253
tireRL__LATERAL__PHY3 = 0
tireRL__LATERAL__PVY1 = -0.01038
tireRL__LATERAL__PVY2 = -0.1
tireRL__LATERAL__PVY3 = 0.4498
tireRL__LATERAL__PVY4 = -1.5
tireRL__LATERAL__RBY1 = 35.304
tireRL__LATERAL__RBY2 = 15.666
tireRL__LATERAL__RBY3 = -0.01179
tireRL__LATERAL__RCY1 = 1.018
tireRL__LATERAL__REY1 = 0.35475
tireRL__LATERAL__REY2 = 0.01966
tireRL__LATERAL__RHY1 = 0.00667
tireRL__LATERAL__RHY2 = 0.00207
tireRL__LATERAL__RVY1 = 0.0426
tireRL__LATERAL__RVY2 = 0.03077
tireRL__LATERAL__RVY3 = 0.37305
tireRL__LATERAL__RVY4 = 100
tireRL__LATERAL__RVY5 = 2.2
tireRL__LATERAL__RVY6 = 25
tireRL__LATERAL__PTY1 = 0
tireRL__LATERAL__PTY2 = 0
tireRL__LATERAL__PEY5 = 0
tireRL__LATERAL__PKY4 = 2
tireRL__LATERAL__PKY5 = 0
tireRL__LATERAL__PKY6 = 0
tireRL__LATERAL__PKY7 = 0
tireRL__LATERAL__PPY1 = 0
tireRL__LATERAL__PPY2 = 0
tireRL__LATERAL__PPY3 = 0
tireRL__LATERAL__PPY4 = 0
tireRL__LATERAL__PPY5 = 0
tireRL__LATERAL__RBY4 = 0
tireRL__ROLLING__QSY1 = 0.015
tireRL__ROLLING__QSY2 = 0
tireRL__ROLLING__QSY3 = 0
tireRL__ROLLING__QSY4 = 0
tireRL__ROLLING__QSY5 = 0
tireRL__ROLLING__QSY6 = 0
tireRL__ROLLING__QSY7 = 1
tireRL__ROLLING__QSY8 = 0
tireRL__ALIGNING__QBZ1 = 12.457
tireRL__ALIGNING__QBZ2 = -0.04661
tireRL__ALIGNING__QBZ3 = 0
tireRL__ALIGNING__QBZ4 = 5.096
tireRL__ALIGNING__QBZ5 = 4.664
tireRL__ALIGNING__QBZ9 = 6.924
tireRL__ALIGNING__QBZ10 = 0
tireRL__ALIGNING__QCZ1 = 1.6
tireRL__ALIGNING__QDZ1 = 0.11496
tireRL__ALIGNING__QDZ2 = 0.00542
tireRL__ALIGNING__QDZ3 = 1.5
tireRL__ALIGNING__QDZ4 = 0
tireRL__ALIGNING__QDZ6 = -0.00023

tireRL__ALIGNING__QDZ7 = -0.02192
tireRL__ALIGNING__QDZ8 = -1.3554
tireRL__ALIGNING__QDZ9 = 0.119
tireRL__ALIGNING__QEZ1 = -10
tireRL__ALIGNING__QEZ2 = 5.742
tireRL__ALIGNING__QEZ3 = 0
tireRL__ALIGNING__QEZ4 = 1.3084
tireRL__ALIGNING__QEZ5 = 1.2514
tireRL__ALIGNING__QHZ1 = 0.01552
tireRL__ALIGNING__QHZ2 = -0.00917
tireRL__ALIGNING__QHZ3 = -0.07129
tireRL__ALIGNING__QHZ4 = 0.03423
tireRL__ALIGNING__SSZ1 = -0.09916
tireRL__ALIGNING__SSZ2 = 0.02588
tireRL__ALIGNING__SSZ3 = 2.2703
tireRL__ALIGNING__SSZ4 = -1.8657
tireRL__ALIGNING__QTZ1 = 0
tireRL__ALIGNING__MBELT = 0
tireRL__ALIGNING__QBZ6 = 0
tireRL__ALIGNING__QDZ10 = 0
tireRL__ALIGNING__QDZ11 = 0
tireRL__ALIGNING__PPZ1 = 0
tireRL__ALIGNING__PPZ2 = 0
tireRL__TURNSLIP__PDXP1 = 0.4
tireRL__TURNSLIP__PDXP2 = 0
tireRL__TURNSLIP__PDXP3 = 0
tireRL__TURNSLIP__PKYP1 = 1
tireRL__TURNSLIP__PDYP1 = 0.4
tireRL__TURNSLIP__PDYP2 = 0
tireRL__TURNSLIP__PDYP3 = 0
tireRL__TURNSLIP__PDYP4 = 0
tireRL__TURNSLIP__PHYP1 = 1
tireRL__TURNSLIP__PHYP2 = 0.15
tireRL__TURNSLIP__PHYP3 = 0
tireRL__TURNSLIP__PHYP4 = -4
tireRL__TURNSLIP__PECP1 = 0.5
tireRL__TURNSLIP__PECP2 = 0
tireRL__TURNSLIP__QDTP1 = 10
tireRL__TURNSLIP__QCRP1 = 0.2
tireRL__TURNSLIP__QCRP2 = 0.1
tireRL__TURNSLIP__QBRP1 = 0.1
tireRL__TURNSLIP__QDRP1 = 1
tireRL__TURNSLIP__QDRP2 = 0
tireRL__CONTACTPATCH__Q_RA1 = 0
tireRL__CONTACTPATCH__Q_RA2 = 0
tireRL__CONTACTPATCH__Q_RB1 = 0
tireRL__CONTACTPATCH__Q_RB2 = 0
tireRL__CONTACTPATCH__k1_TireFB_PT1 = 0.002
tireRL__CONTACTPATCH__k1_WheelsFB_PT1 = 0.002
tireRL__CONTACTPATCH__k2_TireFB_PT1 = 0.002
tireRL__CONTACTPATCH__p_Tires_Pa = 220000
tireRL__STRUCTURAL__LONGITUDINAL_STIFFNESS = 480000
tireRL__STRUCTURAL__LATERAL_STIFFNESS = 120000
tireRL__STRUCTURAL__PCFX1 = 0
tireRL__STRUCTURAL__PCFX2 = 0
tireRL__STRUCTURAL__PCFX3 = 0
tireRL__STRUCTURAL__PCFY1 = 0
tireRL__STRUCTURAL__PCFY2 = 0
tireRL__STRUCTURAL__PCFY3 = 0
tireRR__MFSIMPLE__PacLong_B = 18
tireRR__MFSIMPLE__PacLong_C = 2
tireRR__MFSIMPLE__PacLong_D = 1.7168
tireRR__MFSIMPLE__PacLong_E = 1
tireRR__MFSIMPLE__PacLong_Fznom = 3114
tireRR__MFSIMPLE__PacLong_eps_load = -0.289
tireRR__MFSIMPLE__PacLat_B = 10
tireRR__MFSIMPLE__PacLat_C = 1.603
tireRR__MFSIMPLE__PacLat_D = 1.654
tireRR__MFSIMPLE__PacLat_E = 1
tireRR__MFSIMPLE__PacLat_Fznom = 3114
tireRR__MFSIMPLE__PacLat_eps_load = -0.1783
tireRR__MFSIMPLE__r_tire_m = 0.3118
tireRR__MFSIMPLE__Iyy_Wheel_kgm2 = 1.35
tireRR__ANGLE = 1
tireRR__TYRESIDE = -1
tireRR__USE_MODE = 14
tireRR__LONGVL = 11
tireRR__INERTIAL__m_Wheel_kg = 15
tireRR__INERTIAL__Iyy_Wheel_kgm2 = 1.35
tireRR__WHEEL__br_Nmsprad = 0
tireRR__WHEEL__FNOMIN = 3114
tireRR__WHEEL__NORMPRES = 220000
tireRR__WHEEL__TYRE_RADIUS_MOD = 0.3118
tireRR__WHEEL__T_RelaxationLong = 3.5
tireRR__WHEEL__T_RelaxationLat = 1.5
tireRR__WHEEL__T_RelaxationMy = 100
tireRR__DIMENSION__UNLOADED_RADIUS = 0.3118
tireRR__DIMENSION__WIDTH = 0.295
tireRR__DIMENSION__ASPECT_RATIO = 0.3
tireRR__DIMENSION__RIM_RADIUS = 0.1651
tireRR__DIMENSION__RIM_WIDTH = 0.305
tireRR__VERTICAL__VERTICAL_STIFFNESS = 240000
tireRR__VERTICAL__VERTICAL_DAMPING = 100
tireRR__VERTICAL__BREFF = 3.0e-8
tireRR__VERTICAL__DREFF = 0
tireRR__VERTICAL__FREFF = 0
tireRR__VERTICAL__Q_RE0 = 1
tireRR__VERTICAL__Q_V1 = 0
tireRR__VERTICAL__Q_V2 = 0
tireRR__VERTICAL__Q_FZ1 = 25.36
tireRR__VERTICAL__Q_FZ2 = 0
tireRR__VERTICAL__Q_FZ3 = 0
tireRR__VERTICAL__Q_FCX = 0
tireRR__VERTICAL__Q_FCY = 0
tireRR__VERTICAL__Q_FCY2 = 0
tireRR__VERTICAL__PFZ1 = 0
tireRR__SIMULATION__KPUMIN = -1.5
tireRR__SIMULATION__KPUMAX = 1.5
tireRR__SIMULATION__ALPMIN = -1.5708
tireRR__SIMULATION__ALPMAX = 1.5708
tireRR__SIMULATION__CAMMIN = -0.3147
tireRR__SIMULATION__CAMMAX = 0.3147
tireRR__SIMULATION__FZMIN = 1
tireRR__SIMULATION__FZMAX = 20000
tireRR__SIMULATION__LONGVL = 11
tireRR__SIMULATION__VXLOW = 1
tireRR__SIMULATION__PRESMIN = 10000
tireRR__SIMULATION__PRESMAX = 1000000
tireRR__SCALING__LFZO = 1
tireRR__SCALING__LCX = 1
tireRR__SCALING__LMUX = 1
tireRR__SCALING__LEX = 1
tireRR__SCALING__LKX = 1
tireRR__SCALING__LHX = 1
tireRR__SCALING__LVX = 1
tireRR__SCALING__LGAX = 0
tireRR__SCALING__LCY = 1
tireRR__SCALING__LMUY = 1
tireRR__SCALING__LEY = 1
tireRR__SCALING__LKY = 1
tireRR__SCALING__LHY = 1
tireRR__SCALING__LVY = 1
tireRR__SCALING__LGAY = 0
tireRR__SCALING__LTR = 1
tireRR__SCALING__LRES = 1
tireRR__SCALING__LGAZ = 0
tireRR__SCALING__LXAL = 1
tireRR__SCALING__LYKA = 1
tireRR__SCALING__LVYKA = 1
tireRR__SCALING__LS = 1
tireRR__SCALING__LSGKP = 0
tireRR__SCALING__LSGAL = 0
tireRR__SCALING__LGYR = 0
tireRR__SCALING__LMX = 1
tireRR__SCALING__LVMX = 1
tireRR__SCALING__LMY = 1
tireRR__SCALING__LMUV = 0
tireRR__SCALING__LCZ = 1
tireRR__SCALING__LMPHI = 1
tireRR__LONGITUDINAL__PCX1 = 2
tireRR__LONGITUDINAL__PDX1 = 1.7168
tireRR__LONGITUDINAL__PDX2 = -0.289
tireRR__LONGITUDINAL__PDX3 = 0
tireRR__LONGITUDINAL__PEX1 = 0.6975
tireRR__LONGITUDINAL__PEX2 = 0.20123
tireRR__LONGITUDINAL__PEX3 = 0
tireRR__LONGITUDINAL__PEX4 = 0
tireRR__LONGITUDINAL__PKX1 = 63.75
tireRR__LONGITUDINAL__PKX2 = -15
tireRR__LONGITUDINAL__PKX3 = 0.2891
tireRR__LONGITUDINAL__PHX1 = -0.00058
tireRR__LONGITUDINAL__PHX2 = 0.00079
tireRR__LONGITUDINAL__PVX1 = 0
tireRR__LONGITUDINAL__PVX2 = 0
tireRR__LONGITUDINAL__RBX1 = 17.406
tireRR__LONGITUDINAL__RBX2 = 18.243
tireRR__LONGITUDINAL__RCX1 = 0.7119
tireRR__LONGITUDINAL__REX1 = -10
tireRR__LONGITUDINAL__REX2 = 3.9185
tireRR__LONGITUDINAL__RHX1 = 0.00211
tireRR__LONGITUDINAL__PTX1 = 0
tireRR__LONGITUDINAL__PTX2 = 0
tireRR__LONGITUDINAL__PTX3 = 0
tireRR__LONGITUDINAL__PPX1 = 0
tireRR__LONGITUDINAL__PPX2 = 0
tireRR__LONGITUDINAL__PPX3 = 0
tireRR__LONGITUDINAL__PPX4 = 0
tireRR__LONGITUDINAL__RBX3 = 0
tireRR__OVERTURNING__QSX1 = 0
tireRR__OVERTURNING__QSX2 = 0
tireRR__OVERTURNING__QSX3 = 0
tireRR__OVERTURNING__QSX4 = 0
tireRR__OVERTURNING__QSX5 = 0
tireRR__OVERTURNING__QSX6 = 0
tireRR__OVERTURNING__QSX7 = 0
tireRR__OVERTURNING__QSX8 = 0
tireRR__OVERTURNING__QSX9 = 0
tireRR__OVERTURNING__QSX10 = 0
tireRR__OVERTURNING__QSX11 = 0
tireRR__OVERTURNING__QSX12 = 0
tireRR__OVERTURNING__QSX13 = 0
tireRR__OVERTURNING__QSX14 = 0
tireRR__OVERTURNING__PPMX1 = 0
tireRR__LATERAL__PCY1 = 1.603
tireRR__LATERAL__PDY1 = 1.654
tireRR__LATERAL__PDY2 = -0.1783
tireRR__LATERAL__PDY3 = 0
tireRR__LATERAL__PEY1 = -1.409
tireRR__LATERAL__PEY2 = -1.6617
tireRR__LATERAL__PEY3 = 0.26886

tireRR__LATERAL__PEY4 = -13.61
tireRR__LATERAL__PKY1 = -53.05
tireRR__LATERAL__PKY2 = 4.1265
tireRR__LATERAL__PKY3 = 1.5016
tireRR__LATERAL__PHY1 = 0.0039
tireRR__LATERAL__PHY2 = -0.00253
tireRR__LATERAL__PHY3 = 0
tireRR__LATERAL__PVY1 = -0.01038
tireRR__LATERAL__PVY2 = -0.1
tireRR__LATERAL__PVY3 = 0.4498
tireRR__LATERAL__PVY4 = -1.5
tireRR__LATERAL__RBY1 = 35.304
tireRR__LATERAL__RBY2 = 15.666
tireRR__LATERAL__RBY3 = -0.01179
tireRR__LATERAL__RCY1 = 1.018
tireRR__LATERAL__REY1 = 0.35475
tireRR__LATERAL__REY2 = 0.01966
tireRR__LATERAL__RHY1 = 0.00667
tireRR__LATERAL__RHY2 = 0.00207
tireRR__LATERAL__RVY1 = 0.0426
tireRR__LATERAL__RVY2 = 0.03077
tireRR__LATERAL__RVY3 = 0.37305
tireRR__LATERAL__RVY4 = 100
tireRR__LATERAL__RVY5 = 2.2
tireRR__LATERAL__RVY6 = 25
tireRR__LATERAL__PTY1 = 0
tireRR__LATERAL__PTY2 = 0
tireRR__LATERAL__PEY5 = 0
tireRR__LATERAL__PKY4 = 2
tireRR__LATERAL__PKY5 = 0
tireRR__LATERAL__PKY6 = 0
tireRR__LATERAL__PKY7 = 0
tireRR__LATERAL__PPY1 = 0
tireRR__LATERAL__PPY2 = 0
tireRR__LATERAL__PPY3 = 0
tireRR__LATERAL__PPY4 = 0
tireRR__LATERAL__PPY5 = 0
tireRR__LATERAL__RBY4 = 0
tireRR__ROLLING__QSY1 = 0.015
tireRR__ROLLING__QSY2 = 0
tireRR__ROLLING__QSY3 = 0
tireRR__ROLLING__QSY4 = 0
tireRR__ROLLING__QSY5 = 0
tireRR__ROLLING__QSY6 = 0
tireRR__ROLLING__QSY7 = 1
tireRR__ROLLING__QSY8 = 0
tireRR__ALIGNING__QBZ1 = 12.457
tireRR__ALIGNING__QBZ2 = -0.04661
tireRR__ALIGNING__QBZ3 = 0
tireRR__ALIGNING__QBZ4 = 5.096
tireRR__ALIGNING__QBZ5 = 4.664
tireRR__ALIGNING__QBZ9 = 6.924
tireRR__ALIGNING__QBZ10 = 0
tireRR__ALIGNING__QCZ1 = 1.6
tireRR__ALIGNING__QDZ1 = 0.11496
tireRR__ALIGNING__QDZ2 = 0.00542
tireRR__ALIGNING__QDZ3 = 1.5
tireRR__ALIGNING__QDZ4 = 0
tireRR__ALIGNING__QDZ6 = -0.00023
tireRR__ALIGNING__QDZ7 = -0.02192
tireRR__ALIGNING__QDZ8 = -1.3554
tireRR__ALIGNING__QDZ9 = 0.119
tireRR__ALIGNING__QEZ1 = -10
tireRR__ALIGNING__QEZ2 = 5.742
tireRR__ALIGNING__QEZ3 = 0
tireRR__ALIGNING__QEZ4 = 1.3084
tireRR__ALIGNING__QEZ5 = 1.2514
tireRR__ALIGNING__QHZ1 = 0.01552
tireRR__ALIGNING__QHZ2 = -0.00917
tireRR__ALIGNING__QHZ3 = -0.07129
tireRR__ALIGNING__QHZ4 = 0.03423
tireRR__ALIGNING__SSZ1 = -0.09916
tireRR__ALIGNING__SSZ2 = 0.02588
tireRR__ALIGNING__SSZ3 = 2.2703
tireRR__ALIGNING__SSZ4 = -1.8657
tireRR__ALIGNING__QTZ1 = 0
tireRR__ALIGNING__MBELT = 0
tireRR__ALIGNING__QBZ6 = 0
tireRR__ALIGNING__QDZ10 = 0
tireRR__ALIGNING__QDZ11 = 0
tireRR__ALIGNING__PPZ1 = 0
tireRR__ALIGNING__PPZ2 = 0
tireRR__TURNSLIP__PDXP1 = 0.4
tireRR__TURNSLIP__PDXP2 = 0
tireRR__TURNSLIP__PDXP3 = 0
tireRR__TURNSLIP__PKYP1 = 1
tireRR__TURNSLIP__PDYP1 = 0.4
tireRR__TURNSLIP__PDYP2 = 0
tireRR__TURNSLIP__PDYP3 = 0
tireRR__TURNSLIP__PDYP4 = 0
tireRR__TURNSLIP__PHYP1 = 1
tireRR__TURNSLIP__PHYP2 = 0.15
tireRR__TURNSLIP__PHYP3 = 0
tireRR__TURNSLIP__PHYP4 = -4
tireRR__TURNSLIP__PECP1 = 0.5
tireRR__TURNSLIP__PECP2 = 0
tireRR__TURNSLIP__QDTP1 = 10
tireRR__TURNSLIP__QCRP1 = 0.2
tireRR__TURNSLIP__QCRP2 = 0.1
tireRR__TURNSLIP__QBRP1 = 0.1
tireRR__TURNSLIP__QDRP1 = 1
tireRR__TURNSLIP__QDRP2 = 0
tireRR__CONTACTPATCH__Q_RA1 = 0
tireRR__CONTACTPATCH__Q_RA2 = 0
tireRR__CONTACTPATCH__Q_RB1 = 0
tireRR__CONTACTPATCH__Q_RB2 = 0
tireRR__CONTACTPATCH__k1_TireFB_PT1 = 0.002
tireRR__CONTACTPATCH__k1_WheelsFB_PT1 = 0.002
tireRR__CONTACTPATCH__k2_TireFB_PT1 = 0.002
tireRR__CONTACTPATCH__p_Tires_Pa = 220000
tireRR__STRUCTURAL__LONGITUDINAL_STIFFNESS = 480000
tireRR__STRUCTURAL__LATERAL_STIFFNESS = 120000
tireRR__STRUCTURAL__PCFX1 = 0
tireRR__STRUCTURAL__PCFX2 = 0
tireRR__STRUCTURAL__PCFX3 = 0
tireRR__STRUCTURAL__PCFY1 = 0
tireRR__STRUCTURAL__PCFY2 = 0
tireRR__STRUCTURAL__PCFY3 = 0
VEH__VehicleData__I_K_Vehicle_kgm2__11 = 70
VEH__VehicleData__I_K_Vehicle_kgm2__12 = 0
VEH__VehicleData__I_K_Vehicle_kgm2__13 = 0
VEH__VehicleData__I_K_Vehicle_kgm2__21 = 0
VEH__VehicleData__I_K_Vehicle_kgm2__22 = 470
VEH__VehicleData__I_K_Vehicle_kgm2__23 = 0
VEH__VehicleData__I_K_Vehicle_kgm2__31 = 0
VEH__VehicleData__I_K_Vehicle_kgm2__32 = 0
VEH__VehicleData__I_K_Vehicle_kgm2__33 = 1000
VEH__Tires__p_Tires_pa__1 = 220000
VEH__Tires__p_Tires_pa__2 = 220000
VEH__Tires__p_Tires_pa__3 = 220000
VEH__Tires__p_Tires_pa__4 = 220000
VEH__Brakes__mue_BrakePadsFrRe_static__1 = 0.4
VEH__Brakes__mue_BrakePadsFrRe_static__2 = 0.4
VEH__Brakes__mue_BrakePadsFrRe_kinetic__1 = 0.4
VEH__Brakes__mue_BrakePadsFrRe_kinetic__2 = 0.4
VEH__Brakes__d_BrakeActuatorBoreFrRe_m__1 = 0.0798
VEH__Brakes__d_BrakeActuatorBoreFrRe_m__2 = 0.0798
VEH__Brakes__r_BrakePadsMeanLeverFrRe_m__1 = 0.134
VEH__Brakes__r_BrakePadsMeanLeverFrRe_m__2 = 0.134
VEH__Brakes__n_BrakePadsNumberFrRe__1 = 1
VEH__Brakes__n_BrakePadsNumberFrRe__2 = 1
POWTR__ENGINE__n_ub_rpm__1 = 4800
POWTR__ENGINE__n_ub_rpm__2 = 6950
POWTR__ENGINE__n_ub_rpm__3 = 6950
POWTR__ENGINE__n_ub_rpm__4 = 6950
POWTR__ENGINE__n_ub_rpm__5 = 6950
POWTR__ENGINE__n_ub_rpm__6 = 6950
POWTR__ENGINE__n_lb_rpm__1 = 3000
POWTR__ENGINE__n_lb_rpm__2 = 3000
POWTR__ENGINE__n_lb_rpm__3 = 3000
POWTR__ENGINE__n_lb_rpm__4 = 3000
POWTR__ENGINE__n_lb_rpm__5 = 3000
POWTR__ENGINE__n_lb_rpm__6 = 3000
POWTR__TRANSMISSION__gear__1 = 1
POWTR__TRANSMISSION__gear__2 = 2
POWTR__TRANSMISSION__gear__3 = 3
POWTR__TRANSMISSION__gear__4 = 4
POWTR__TRANSMISSION__gear__5 = 5
POWTR__TRANSMISSION__gear__6 = 6
POWTR__TRANSMISSION__gear_ratio__1 = 2.9167
POWTR__TRANSMISSION__gear_ratio__2 = 1.875
POWTR__TRANSMISSION__gear_ratio__3 = 1.3809
POWTR__TRANSMISSION__gear_ratio__4 = 1.1154
POWTR__TRANSMISSION__gear_ratio__5 = 0.96
POWTR__TRANSMISSION__gear_ratio__6 = 0.8889
POWTR__TRANSMISSION__gear_efficiency__1 = 0.91
POWTR__TRANSMISSION__gear_efficiency__2 = 0.91
POWTR__TRANSMISSION__gear_efficiency__3 = 0.91
POWTR__TRANSMISSION__gear_efficiency__4 = 0.96
POWTR__TRANSMISSION__gear_efficiency__5 = 0.96
POWTR__TRANSMISSION__gear_efficiency__6 = 0.96
INIT__initialvalues__Vehicle_InitialVelocity_mps__1 = 0.1
INIT__initialvalues__Vehicle_InitialVelocity_mps__2 = 0
INIT__initialvalues__Vehicle_InitialVelocity_mps__3 = 0
INIT__initialvalues__x0_verticaldynamics__1 = 0
INIT__initialvalues__x0_verticaldynamics__2 = 0
INIT__initialvalues__x0_verticaldynamics__3 = 0
INIT__initialvalues__omega0_Wheels_radps__1 = 0
INIT__initialvalues__omega0_Wheels_radps__2 = 0
INIT__initialvalues__omega0_Wheels_radps__3 = 0
INIT__initialvalues__omega0_Wheels_radps__4 = 0
INIT__initialvalues__v0z_Wheels_mps__1 = 0
INIT__initialvalues__v0z_Wheels_mps__2 = 0
INIT__initialvalues__v0z_Wheels_mps__3 = 0
INIT__initialvalues__v0z_Wheels_mps__4 = 0
INIT__initialvalues__z0_TireDeflection_m__1 = 0.01434
INIT__initialvalues__z0_TireDeflection_m__2 = 0.01434
INIT__initialvalues__z0_TireDeflection_m__3 = 0.01325
INIT__initialvalues__z0_TireDeflection_m__4 = 0.01325
SUS__Compliance__cz_SpringRateFrRe_Npm__1 = 191903
SUS__Compliance__cz_SpringRateFrRe_Npm__2 = 111694
SUS__Compliance__F0z_SpringPreloadFrRe_N__1 = 2364.365714
SUS__Compliance__F0z_SpringPreloadFrRe_N__2 = 3502.0142857
SUS__Compliance__Cz_DamperRateFrRe_Nspm__1 = 2152.7777
SUS__Compliance__Cz_DamperRateFrRe_Nspm__2 = 1377.777777
SUS__Kinematics__nu0_ToeATSteerCenterFrRe_rad__1 = 0
SUS__Kinematics__nu0_ToeATSteerCenterFrRe_rad__2 = 0
SUS__Kinematics__k_RollSteerVSHeightFrRe_radpm__1 = 0
SUS__Kinematics__k_RollSteerVSHeightFrRe_radpm__2 = 0
SUS__Kinematics__k_CasterATSteerCenterF__1 = 0

SUS__Kinematics__k_CasterATSteerCenterF__2 = 0.01
SUS__Kinematics__k_CasterVSHeightFrRe__1 = 0
SUS__Kinematics__k_CasterVSHeightFrRe__2 = 0
SUS__Kinematics__k_CamberATSteerCenterF__1 = 0
SUS__Kinematics__k_CamberATSteerCenterF__2 = 0.01
SUS__Kinematics__k_CamberVSHeightFrRe__1 = 0
SUS__Kinematics__k_CamberVSHeightFrRe__2 = 0
SUS__Antisway__r_AntiSwayArmRadiusFrRe_m__1 = 0.482
SUS__Antisway__r_AntiSwayArmRadiusFrRe_m__2 = 0.35
SUS__Antisway__phi_AntiSwayNeutralAngleFrRe_rad__1 = 0
SUS__Antisway__phi_AntiSwayNeutralAngleFrRe_rad__2 = 0
SUS__Antisway__c_AntiSwayTSpringFrRe_Nmprad__1 = 6042.9752
SUS__Antisway__c_AntiSwayTSpringFrRe_Nmprad__2 = 0
current_vehicleparameters = "il"
x0_stm_vehiclestates = repmat(0, 8, 1)