% Simulink data dictionary enginemap.sldd
% references simulation_modelconfig.sldd
% references simulation_interfaces.sldd

breakpoints_x = [500; 600; 700; 800; 900; 1000; 1100; 1200; 1300; 1400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 7500]

table2d_map = [0 53.98485 56.21621 63.41803 74.84238 86.06938 93.5 104.5
 -3.3 56.14424 58.26044 66.19257 78.83397 91.13229 99 110
 -6.6 58.30364 60.30466 68.96711 82.82557 96.19519 104.5 115.5
 -9.9 60.46303 62.34889 71.74165 86.81716 101.2581 110 121
 -13.2 62.62243 64.39312 74.51619 90.80875 106.321 115.5 126.5
 -16.5 64.78182 66.43734 77.29073 94.80035 111.3839 121 132
 -19.8 69.10061 70.52579 80.65981 97.79404 115.4342 125.4 136.4
 -23.1 73.4194 74.61425 84.02889 100.7877 119.4846 129.8 140.8
 -26.4 77.73819 78.7027 87.39798 103.7814 123.5349 134.2 145.2
 -29.7 82.05697 82.79115 90.76706 106.7751 127.5852 138.6 149.6
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 ]

breakpoints_y = [0 0.3 0.5 0.65 0.7 0.8 0.9 1]