% Simulink data dictionary db_sim_MF52tireparameters.sldd

mounted_side = 1

par_TIR_front = struct(
  WIDTH=0.295,
  ASPECT_RATIO=0.3,
  RIM=18,
  IP=200,
  DIAMETER=0.6342,
  VERTICAL_STIFFNESS_CALC=260518.6,
  ANGLE=1,
  TYRESIDE=-1,
  USE_MODE=14,
  LONGVL=11,
  UNLOADED_RADIUS=0.317,
  RIM_RADIUS=0.229,
  RIM_WIDTH=0.2667,
  VERTICAL_STIFFNESS=240000,
  VERTICAL_DAMPING=100,
  BREFF=3.0e-8,
  DREFF=0,
  FREFF=0,
  FNOMIN=3000,
  KPUMIN=-1.5,
  KPUMAX=1.5,
  ALPMIN=-1.5708,
  ALPMAX=1.5708,
  CAMMIN=-0.3147,
  CAMMAX=0.3147,
  FZMIN=1,
  FZMAX=20000,
  LFZO=1,
  LCX=1,
  LMUX=0.97,
  LEX=1,
  LKX=1,
  LHX=1,
  LVX=1,
  LGAX=1,
  LCY=1,
  LMUY=0.97,
  LEY=1,
  LKY=1,
  LHY=1,
  LVY=1,
  LGAY=1,
  LTR=1,
  LRES=1,
  LGAZ=1,
  LXAL=1,
  LYKA=1,
  LVYKA=1,
  LS=1,
  LSGKP=1,
  LSGAL=1,
  LGYR=1,
  LMX=1,
  LVMX=1,
  LMY=1,
  PCX1=1.6442,
  PDX1=1.5315,
  PDX2=-0.042865,
  PDX3=0.1,
  PEX1=0.69637,
  PEX2=-0.16976,
  PEX3=0.02267,
  PEX4=-0.14313,
  PKX1=30.732,
  PKX2=0.27129,
  PKX3=0.12779,
  PHX1=0,
  PHX2=0,
  PVX1=0,
  PVX2=0,
  RBX1=17.409,
  RBX2=12.892,
  RCX1=1.0968,
  REX1=0,
  REX2=0,
  RHX1=0.0012757,
  PTX1=0.75376,
  PTX2=0.0066539,
  PTX3=-0.12779,
  QSX1=-0.00083931,
  QSX2=2.1019,
  QSX3=-0.036019,
  PCY1=1.5675,
  PDY1=1.286,
  PDY2=-0.093005,
  PDY3=0.1,
  PEY1=0.10679,
  PEY2=-1.2054,
  PEY3=0.048624,
  PEY4=-8.1214,
  PKY1=-75.4754,
  PKY2=4.6534,
  PKY3=-0.59931,
  PHY1=0.0028301,
  PHY2=-0.00063745,
  PHY3=0.0038339,
  PVY1=0.040667,
  PVY2=-0.019226,
  PVY3=-0.96889,
  PVY4=-0.41406,
  RBY1=20.57,
  RBY2=-23.533,
  RBY3=0.0010504,
  RCY1=1.0094,
  REY1=0,
  REY2=0,
  RHY1=-0.019642,
  RHY2=0,
  RVY1=0.15504,
  RVY2=0.027779,
  RVY3=27.548,
  RVY4=-29.67,
  RVY5=0.033819,
  RVY6=0,
  PTY1=3.796,
  PTY2=4.6534,
  QSY1=0.01,
  QSY2=0,
  QSY3=0,
  QSY4=0,
  QBZ1=9.0352,
  QBZ2=6.2747,
  QBZ3=-0.49801,
  QBZ4=-2.2859,
  QBZ5=2.687,
  QBZ9=-13.4538,
  QBZ10=0,
  QCZ1=1.1112,
  QDZ1=0.075296,
  QDZ2=0.0035884,
  QDZ3=-1.9194,
  QDZ4=-1.9825,
  QDZ6=-0.0050047,
  QDZ7=0.011095,
  QDZ8=-0.65039,
  QDZ9=-0.059214,
  QEZ1=-9.0284,
  QEZ2=11.0045,
  QEZ3=-5.8712,
  QEZ4=0.2394,
  QEZ5=-15.9158,
  QHZ1=0.0069694,
  QHZ2=-0.00091253,
  QHZ3=-0.18162,
  QHZ4=0.22912,
  SSZ1=-0.01265,
  SSZ2=0.048488,
  SSZ3=2.4368,
  SSZ4=-1.0105,
  QTZ1=0,
  MBELT=0)

par_TIR_rear = struct(
  WIDTH=0.345,
  ASPECT_RATIO=0.3,
  RIM=20,
  IP=200,
  DIAMETER=0.715,
  VERTICAL_STIFFNESS_CALC=294124.2,
  ANGLE=1,
  TYRESIDE=-1,
  USE_MODE=14,
  LONGVL=11,
  UNLOADED_RADIUS=0.357,
  RIM_RADIUS=0.254,
  RIM_WIDTH=0.3048,
  VERTICAL_STIFFNESS=240000,
  VERTICAL_DAMPING=100,
  BREFF=3.0e-8,
  DREFF=0,
  FREFF=0,
  FNOMIN=3000,
  KPUMIN=-1.5,
  KPUMAX=1.5,
  ALPMIN=-1.5708,
  ALPMAX=1.5708,
  CAMMIN=-0.3147,
  CAMMAX=0.3147,
  FZMIN=1,
  FZMAX=20000,
  LFZO=1,
  LCX=1,
  LMUX=1.03,
  LEX=1,
  LKX=1,
  LHX=1,
  LVX=1,
  LGAX=1,
  LCY=1,
  LMUY=1.03,
  LEY=1,
  LKY=1,
  LHY=1,
  LVY=1,
  LGAY=1,
  LTR=1,
  LRES=1,
  LGAZ=1,
  LXAL=1,
  LYKA=1,
  LVYKA=1,
  LS=1,
  LSGKP=1,
  LSGAL=1,
  LGYR=1,
  LMX=1,
  LVMX=1,
  LMY=1,
  PCX1=1.6442,
  PDX1=1.5376,
  PDX2=-0.072769,
  PDX3=0.1,
  PEX1=0.62937,
  PEX2=-0.21385,
  PEX3=0.045583,
  PEX4=-0.14313,
  PKX1=32.5377,
  PKX2=0.40579,
  PKX3=0.1812,
  PHX1=0,
  PHX2=0,
  PVX1=0,
  PVX2=0,
  RBX1=17.409,
  RBX2=12.892,
  RCX1=1.0968,
  REX1=0,
  REX2=0,
  RHX1=0.0012757,
  PTX1=0.94782,
  PTX2=0.011821,
  PTX3=-0.1812,
  QSX1=0.0041004,
  QSX2=1.7411,
  QSX3=-0.031164,
  PCY1=1.537,
  PDY1=1.2797,
  PDY2=-0.15789,
  PDY3=0.1,
  PEY1=-0.29413,
  PEY2=-1.2831,
  PEY3=-0.035148,
  PEY4=-9.3362,
  PKY1=-48.2766,
  PKY2=2.3622,
  PKY3=-0.40696,
  PHY1=0.0018773,
  PHY2=0.00025523,
  PHY3=0.031289,
  PVY1=0.025932,
  PVY2=0.0007419,
  PVY3=-0.61073,
  PVY4=-0.5768,
  RBY1=20.57,
  RBY2=-23.533,
  RBY3=0.0010504,
  RCY1=1.0094,
  REY1=0,
  REY2=0,
  RHY1=-0.019642,
  RHY2=0,
  RVY1=0.15504,
  RVY2=0.039391,
  RVY3=27.548,
  RVY4=-29.67,
  RVY5=0.033819,
  RVY6=0,
  PTY1=1.948,
  PTY2=2.3622,
  QSY1=0.01,
  QSY2=0,
  QSY3=0,
  QSY4=0,
  QBZ1=13.1381,
  QBZ2=-2.8168,
  QBZ3=9.3795,
  QBZ4=-0.83826,
  QBZ5=2.6271,
  QBZ9=20.0802,
  QBZ10=0,
  QCZ1=1.0585,
  QDZ1=0.108,
  QDZ2=0.007747,
  QDZ3=-2.0992,
  QDZ4=166.6251,
  QDZ6=0.0079695,
  QDZ7=0.001392,
  QDZ8=-0.95936,
  QDZ9=0.016346,
  QEZ1=-6.7407,
  QEZ2=-2.6773,
  QEZ3=7.7712,
  QEZ4=0.033502,
  QEZ5=-10.3954,
  QHZ1=0.005606,
  QHZ2=-0.0021093,
  QHZ3=-0.28647,
  QHZ4=0.33774,
  SSZ1=-0.011236,
  SSZ2=0.06107,
  SSZ3=2.1645,
  SSZ4=-0.89758,
  QTZ1=0,
  MBELT=0)